# Grasshopper definition matlab_hops_PDE_2D_mult.gh (Grasshopper 1.0.7)
# plug-ins: Hops, Pufferfish, Pancake, Kangaroo2 Components, Human, LadybugGrasshopper, Weaverbird, MetaHopper, FalseStartToggle, LunchBox, Kangaroo Components, froGH, karambaGH

# Parameter Generator
panel = Panel("")

# ---- group: COMP:Iteration Get
number_slider = Slider(1, range=0..1)

# ---- group: COMP:Iteration Amount
# Use this method to Iterate
number_slider_2 = Slider(10, range=0..10)

# ---- group: VAR:
dom = ConstructDomain(DomainStart=Slider(0.1, range=0..1), DomainEnd=Slider(0.75, range=0..1))
range = Range(Domain=dom, Steps=expr("x-1", number_slider_2))

# ----
eval = Evaluate(F="round(x,y)", x=range, y=Slider(2, range=0..10))
crossref = CrossReference(ListA=eval, ListB=eval, CrossMode=1)  # -> ListA, ListB

sqr = Square(Value=number_slider_2)
max_numb = Panel(sqr)
subtraction = Subtraction(A=sqr, B=1)
multiplication = Multiplication(A=number_slider, B=subtraction)

# ---- group: VAR:
division = Division(A=Slider(1, range=0..1), B=2)
neg = Negative(Value=division)
dom_2 = ConstructDomain(DomainStart=division, DomainEnd=neg)

division_2 = Division(A=Slider(1, range=0..1), B=2)
neg_2 = Negative(Value=division_2)
dom_3 = ConstructDomain(DomainStart=division_2, DomainEnd=neg_2)

# ----
item = ListItem(List=crossref.ListA, Index=multiplication, Wrap=True)
item_2 = ListItem(List=crossref.ListB, Index=multiplication, Wrap=True)

remap = RemapNumbers(Value=multiplication, Source=subtraction, Target=Domain(0, 1))  # -> Mapped, Clipped
animate = Data(remap.Mapped)

# ---- group: COMP:
automate = FalseStartToggle(False)

# ---- group: VAR:
number_slider_3 = Slider(0.31, range=0..1)
number_slider_4 = Slider(0.29, range=0..1)

# ----
merge = Merge(
    Data1=ColourSwatch(SwatchColor=RGB(255, 255, 255)),
    Data2=ColourSwatch(SwatchColor=RGB(255, 0, 0)),
    Data3=ColourSwatch(SwatchColor=RGB(213, 0, 255)),
    Data4=ColourSwatch(SwatchColor=RGB(106, 0, 255)),
    Data5=ColourSwatch(SwatchColor=RGB(255, 0, 255)),
    Data6=ColourSwatch(SwatchColor=RGB(255, 251, 0)),
    Data7=ColourSwatch(SwatchColor=RGB(0, 136, 255)))  # -> graft(Result)

# ---- group: VAR:
division_3 = Division(A=Slider(1, range=0..1), B=2)
neg_3 = Negative(Value=division_3)
dom_4 = ConstructDomain(DomainStart=division_3, DomainEnd=neg_3)

division_4 = Division(A=Slider(1, range=0..1), B=2)
neg_4 = Negative(Value=division_4)
dom_5 = ConstructDomain(DomainStart=division_4, DomainEnd=neg_4)

# ----
filter = StreamFilter(Gate=automate, Stream0=number_slider_3, Stream1=item)
filter_2 = StreamFilter(Gate=automate, Stream0=number_slider_4, Stream1=item_2)
rectangle = Rectangle(Plane=PlaneXY(0, 0, 0), XSize=dom_2, YSize=dom_3, Radius=0)  # -> Rectangle, Length

md_slider = MDSlider(
    SliderMode=0,
    slider_value=Point(0.2875003815, 0.2874984741, 0.5),
    x_domain=Domain(0, 1),
    y_domain=Domain(0, 1),
    z_domain=Domain(0, 1))
md_slider_2 = MDSlider(
    SliderMode=0,
    slider_value=Point(0.7442559302, 0.2222480774, 0.5),
    x_domain=Domain(0, 1),
    y_domain=Domain(0, 1),
    z_domain=Domain(0, 1))
md_slider_3 = MDSlider(
    SliderMode=0,
    slider_value=Point(0.7523441315, 0.7124977112, 0.5),
    x_domain=Domain(0, 1),
    y_domain=Domain(0, 1),
    z_domain=Domain(0, 1))
evalsrf = EvaluateSurface(Surface=reparameterize(rectangle.Rectangle), Point=md_slider)  # -> Point, Normal, UDirection, VDirection, Frame
evalsrf_2 = EvaluateSurface(Surface=reparameterize(rectangle.Rectangle), Point=md_slider_2)  # -> Point, Normal, UDirection, VDirection, Frame
evalsrf_3 = EvaluateSurface(Surface=reparameterize(rectangle.Rectangle), Point=md_slider_3)  # -> Point, Normal, UDirection, VDirection, Frame
polygon = Polygon(Plane=evalsrf_3.Point, Radius=Slider(0.2, range=0..1), Segments=Slider(15, range=0..100), FilletRadius=0)  # -> Polygon, Length
polygon_2 = Polygon(Plane=evalsrf.Point, Radius=Slider(0.12, range=0..1), Segments=Slider(20, range=0..100), FilletRadius=0)  # -> Polygon, Length
polygon_3 = Polygon(Plane=evalsrf_2.Point, Radius=Slider(0.08, range=0..1), Segments=Slider(20, range=0..100), FilletRadius=0)  # -> Polygon, Length
merge_2 = Merge(Data1=polygon.Polygon, Data2=polygon_2.Polygon, Data3=polygon_3.Polygon)

# ---- group: VAR:
W = Data(filter)
H = Data(filter_2)

eval_2 = Evaluate(F="format(\"W{0}H{1}\",x,y)", x=W, y=H)
objectname = Data(eval_2)

# ----
number_slider_5 = Slider(10, range=0..10)
# PDE 2D Multiple Inputs
# Geometry Generator
panel_2 = Panel("")
rectangle_2 = Rectangle(Plane=PlaneXY(0, 0, 0), XSize=dom_4, YSize=dom_5, Radius=0)  # -> Rectangle, Length
random = Random(Range=Domain(0, 1), Number=number_slider_5, Seed=2)

number_slider_6 = Slider(1, range=0..10)
neg_5 = Negative(Value=Slider(0.25, range=0..1))
offset = OffsetCurve(Curve=rectangle.Rectangle, Distance=neg_5, Corners=1)
sdivide = DivideSurface(Surface=offset, UCount=number_slider_6, VCount=number_slider_6)  # -> Points, Normals, Parameters
polygon_4 = Polygon(Plane=sdivide.Points, Radius=Slider(0.15, range=0..0.2), Segments=Slider(20, range=0..100), FilletRadius=0)  # -> flatten(Polygon), Length

number_slider_7 = Slider(2, range=0..10)
neg_6 = Negative(Value=Slider(0.19, range=0..1))
offset_2 = OffsetCurve(Curve=rectangle.Rectangle, Distance=neg_6, Corners=1)
sdivide_2 = DivideSurface(Surface=offset_2, UCount=number_slider_7, VCount=number_slider_7)  # -> Points, Normals, Parameters
polygon_5 = Polygon(Plane=sdivide_2.Points, Radius=Slider(0.12, range=0..0.2), Segments=Slider(20, range=0..100), FilletRadius=0)  # -> flatten(Polygon), Length

number_slider_8 = Slider(4, range=0..10)
neg_7 = Negative(Value=Slider(0.13, range=0..1))
offset_3 = OffsetCurve(Curve=rectangle.Rectangle, Distance=neg_7, Corners=1)
sdivide_3 = DivideSurface(Surface=offset_3, UCount=number_slider_8, VCount=number_slider_8)  # -> Points, Normals, Parameters
polygon_6 = Polygon(Plane=sdivide_3.Points, Radius=Slider(0.07, range=0..0.2), Segments=Slider(20, range=0..100), FilletRadius=0)  # -> flatten(Polygon), Length

division_5 = Division(A=Slider(0.1, range=0..1), B=2)
neg_8 = Negative(Value=division_5)
dom_6 = ConstructDomain(DomainStart=division_5, DomainEnd=neg_8)

division_6 = Division(A=Slider(0.75, range=0..1), B=2)
neg_9 = Negative(Value=division_6)
dom_7 = ConstructDomain(DomainStart=division_6, DomainEnd=neg_9)

pop2d = Populate2D(Region=rectangle_2.Rectangle, Count=number_slider_5, Seed=1)

division_7 = Division(A=W, B=2)
neg_10 = Negative(Value=division_7)
dom_8 = ConstructDomain(DomainStart=division_7, DomainEnd=neg_10)

division_8 = Division(A=H, B=2)
neg_11 = Negative(Value=division_8)
dom_9 = ConstructDomain(DomainStart=division_8, DomainEnd=neg_11)

larger = LargerThan(FirstNumber=random, SecondNumber=0.5)  # -> LargerThan, OrEqualTo
md_slider_4 = MDSlider(
    SliderMode=0,
    slider_value=Point(0.6039142609, 0.6047160625, 0.5),
    x_domain=Domain(0, 1),
    y_domain=Domain(0, 1),
    z_domain=Domain(0, 1))
dom_10 = ConstructDomain(DomainStart=0, DomainEnd=Slider(1000, range=0..1000))
remap_2 = RemapNumbers(Value=random, Source=Domain(0, 1), Target=dom_10)  # -> Mapped, Clipped
repeat = RepeatData(Data="Temperature", Length=number_slider_5)
repeat_2 = RepeatData(Data="HeatFlux", Length=number_slider_5)
evalsrf_4 = EvaluateSurface(Surface=reparameterize(rectangle.Rectangle), Point=md_slider_4)  # -> Point, Normal, UDirection, VDirection, Frame

rectangle_3 = Rectangle(Plane=evalsrf_4.Point, XSize=dom_8, YSize=dom_9, Radius=0)  # -> Rectangle, Length

p_n_c = PickNChoose(Pattern=larger.LargerThan, Stream0=repeat, Stream1=repeat_2)

rectangle_4 = Rectangle(Plane=PlaneXY(0, 0, 0), XSize=dom_6, YSize=dom_7, Radius=0)  # -> Rectangle, Length

area = Area(Geometry=rectangle_3.Rectangle)  # -> Area, Centroid
col2pt = ColorToPoint()  # -> Point, Alpha
hops = Hops(
    Point=pop2d,
    Mode=p_n_c,
    Temperature=remap_2.Mapped,
    CacheResultsInMemory=False,
    CacheSolveResults=False,
    RemoteDefinitionLocation="http://127.0.0.1:5000/list_access",
    RemoteSolveVersion=(0, 1, 0),
    ShowInput_Enabled=False,
    ShowInput_Path=False,
    SynchronousSolve=True)  # -> A, B, C
rotate = Rotate(Geometry=rectangle_3.Rectangle, Angle=degrees(Slider(30, range=0..90)), Plane=area.Centroid)  # -> Geometry, Transform

merge_3 = Merge(Data1=rectangle.Rectangle, Data2=rotate.Geometry)  # -> flatten(Result)
boundary = BoundarySurfaces(Edges=merge_3)

panel_3 = Panel(hops.A)
# Mesh
panel_4 = Panel("")
panel_5 = Panel(hops.B)

# ---- group: VAR:
number_slider_9 = Slider(0.01, range=0..0.2)
number_slider_10 = Slider(0.05, range=0..0.2)

# ---- group: COMP:
custom_mesh_settings = SettingsCustom(
    StitchSeams=True,
    SimplePlanes=False,
    Refine=True,
    MinCount=16,
    MaxCount=400,
    AspectRatio=20,
    MaxDistance=0,
    MaxAngle=20,
    MinEdge=number_slider_9,
    MaxEdge=number_slider_10)
mesh = MeshBrep(Brep=boundary, Settings=custom_mesh_settings)
triremesh = TriRemesh(Geometry=mesh, Sharp=Toggle(True), Length=number_slider_10, Iterations=Slider(10, range=0..100))  # -> Triangulation, Dual, Creases
exported_mesh = Geometry(triremesh.Triangulation)

# ----
panel_6 = Panel(hops.C)
work_dir = WorkingDirectory(reset=Button())  # -> folder_name, file_name; inputs reset: Boolean
# ---------- work_dir: Python ----------
#Get the path
dir = ghenv.Component.OnPingDocument().FilePath

#Reset
if reset:
    file_name = dir
else:
    file_name = dir

#
warning = "You should save the files first"
dash = '\\'

#get data
if file_name is None:
    file_name = warning
    folder_name = warning
else:
    sp = file_name.split(dash)
    folder_name = file_name.replace(sp[-1],"")
# ---------- end work_dir ----------

# ---- group: VAR:
sub_directory = Panel("2d\")
stl_file_name = Panel("plate.stl")
concat = Concatenate(FragmentC=work_dir.folder_name, FragmentA=sub_directory, FragmentB=stl_file_name)

# ----
number_slider_11 = Slider(5, range=0..100)
number_slider_12 = Slider(62, range=0..100)
matlab_add = MatlabAdd(
    A=number_slider_11,
    B=number_slider_12,
    CacheResultsInMemory=False,
    CacheSolveResults=False,
    RemoteDefinitionLocation="http://127.0.0.1:5000/add",
    RemoteSolveVersion=(0, 1, 0),
    ShowInput_Enabled=False,
    ShowInput_Path=False,
    SynchronousSolve=True)
matlab_mult = MatlabMultiply(
    A=number_slider_11,
    B=number_slider_12,
    CacheResultsInMemory=False,
    CacheSolveResults=False,
    RemoteDefinitionLocation="http://127.0.0.1:5000/mult",
    RemoteSolveVersion=(0, 1, 0),
    ShowInput_Enabled=False,
    ShowInput_Path=False,
    SynchronousSolve=True)
addition = Addition(A=number_slider_11, B=number_slider_12)
# Mesh Expot
multiplication_2 = Multiplication(A=number_slider_11, B=number_slider_12)
panel_7 = Panel([matlab_add, addition])
panel_8 = Panel([matlab_mult, multiplication_2])

panel_9 = Panel(concat)

# ---- group: VAR:
series = Series(Start=Slider(-1000, range=-1000..1000), Step=Slider(100, range=0..100), Count=Slider(21, range=0..100))
list = ItemSelector(
    series,
    {"-1000", "-900", "-800", "-700", "-600", "-500", "-400", "-300", "-200", "-100", "0", "100", "200", "300", "400", "500", "600", "700", "800", "900", "1000"}, selected="1000")
list_2 = ItemSelector(
    series,
    {"-1000", "-900", "-800", "-700", "-600", "-500", "-400", "-300", "-200", "-100", "0", "100", "200", "300", "400", "500", "600", "700", "800", "900", "1000"}, selected="0")
list_3 = ItemSelector(
    series,
    {"-1000", "-900", "-800", "-700", "-600", "-500", "-400", "-300", "-200", "-100", "0", "100", "200", "300", "400", "500", "600", "700", "800", "900", "1000"}, selected="0")
list_4 = ItemSelector(
    series,
    {"-1000", "-900", "-800", "-700", "-600", "-500", "-400", "-300", "-200", "-100", "0", "100", "200", "300", "400", "500", "600", "700", "800", "900", "1000"}, selected="0")
list_5 = ItemSelector(
    series,
    {"-1000", "-900", "-800", "-700", "-600", "-500", "-400", "-300", "-200", "-100", "0", "100", "200", "300", "400", "500", "600", "700", "800", "900", "1000"}, selected="0")
list_6 = ItemSelector(
    series,
    {"-1000", "-900", "-800", "-700", "-600", "-500", "-400", "-300", "-200", "-100", "0", "100", "200", "300", "400", "500", "600", "700", "800", "900", "1000"}, selected="0")
merge_4 = Merge(Data1=list, Data2=list_2, Data3=list_3, Data4=list_4, Data5=list_5, Data6=list_6)
num = Number(merge_4)

# ---- group: COMP:
pcexportstl = ExportSTL(
    Mesh=exported_mesh,
    Relocate=Toggle(False),
    SavePath=concat,
    SaveAsBinaryFile=Toggle(True),
    SaveNow=Toggle(True),
    LastSaveLocalization="neutral,N")

# ---- group: VAR:
md_slider_5 = MDSlider(
    SliderMode=0,
    slider_value=Point(0, 0.411945343, 0.5),
    x_domain=Domain(0, 1),
    y_domain=Domain(0, 1),
    z_domain=Domain(0, 1))
md_slider_6 = MDSlider(
    SliderMode=0,
    slider_value=Point(0.4741439819, 0.5474128723, 0.5),
    x_domain=Domain(0, 1),
    y_domain=Domain(0, 1),
    z_domain=Domain(0, 1))
md_slider_7 = MDSlider(
    SliderMode=0,
    slider_value=Point(0.4861488342, 0, 0.5),
    x_domain=Domain(0, 1),
    y_domain=Domain(0, 1),
    z_domain=Domain(0, 1))
md_slider_8 = MDSlider(
    SliderMode=0,
    slider_value=Point(0.7403488159, 0.6919174194, 0.5),
    x_domain=Domain(0, 1),
    y_domain=Domain(0, 1),
    z_domain=Domain(0, 1))
md_slider_9 = MDSlider(
    SliderMode=0,
    slider_value=Point(0.2549209595, 1, 0.5),
    x_domain=Domain(0, 1),
    y_domain=Domain(0, 1),
    z_domain=Domain(0, 1))
md_slider_10 = MDSlider(
    SliderMode=0,
    slider_value=Point(1, 0.5138511658, 0.5),
    x_domain=Domain(0, 1),
    y_domain=Domain(0, 1),
    z_domain=Domain(0, 1))
merge_5 = Merge(Data1=md_slider_5, Data2=md_slider_7, Data3=md_slider_9, Data4=md_slider_6, Data5=md_slider_8, Data6=md_slider_10)

panel_12 = Panel("""Temperature
HeatFlux""")
list_7 = ItemSelector(panel_12, {"Temperature", "HeatFlux"}, selected="HeatFlux")
list_8 = ItemSelector(panel_12, {"Temperature", "HeatFlux"}, selected="HeatFlux")
list_9 = ItemSelector(panel_12, {"Temperature", "HeatFlux"}, selected="HeatFlux")
list_10 = ItemSelector(panel_12, {"Temperature", "HeatFlux"}, selected="HeatFlux")
list_11 = ItemSelector(panel_12, {"Temperature", "HeatFlux"}, selected="HeatFlux")
list_12 = ItemSelector(panel_12, {"Temperature", "HeatFlux"}, selected="HeatFlux")
merge_6 = Merge(Data1=list_7, Data2=list_8, Data3=list_9, Data4=list_10, Data5=list_11, Data6=list_12)

# ---- group: COMP:
pcimportfrom = ImportFrom(File=concat, LastSaveLocalization="neutral,N")  # -> Geo, Layer, ObjectAttributes; disabled

# ---- group: VAR:
number_slider_13 = Slider(0.6, range=0..1)
temp1 = Slider(1000, range=-1..1000)
temp2 = Slider(0, range=-1000..1000)
number_slider_14 = Slider(0.5, range=0..1)
number_slider_15 = Slider(0.2, range=0..10)
number_slider_16 = Slider(50, range=0..200)

# ----
export_status = Panel(pcexportstl)

brep_geo = Geometry(boundary)
bbox = BoundingBox(Content=brep_geo, Plane=PlaneXY(0, 0, 0))  # -> Box, Box_2

# ----
# Plot Boundary
panel_13 = Panel("")

bbox_2 = BoundingBox(Content=flatten(exported_mesh), Plane=PlaneXY(0, 0, 0), UnionBox=True)  # -> Box, Box_2
area_2 = Area(Geometry=bbox_2.Box)  # -> Area, Centroid
scale_nu = ScaleNU(Geometry=bbox_2.Box, Plane=area_2.Centroid, ScaleX=Slider(1.2, range=0..10), ScaleY=1, ScaleZ=1)  # -> Geometry, Transform
debrep = DeconstructBrep(Brep=scale_nu.Geometry)  # -> Faces, Edges, Vertices

# ---- group: VAR:
list_13 = ValueList({"Steady State": True, "Transient": False}, selected="Transient")
path = FilePath(concat)

# ---- group: COMP:
# Matlab PDE 2D
run = FalseStartToggle(True)
filter_3 = StreamFilter(Gate=run, Stream1=list_13)

# ----
pcen = PolygonCenter(Polyline=debrep.Edges)  # -> CenterV, CenterE, CenterA
pdecon = Deconstruct(Point=pcen.CenterE)  # -> XComponent, YComponent, ZComponent
sort = SortList(Keys=pdecon.XComponent, ValuesA=debrep.Edges)  # -> Keys, ValuesA
item_3 = ListItem(List=reverse(sort.ValuesA), Index=0, Wrap=True)

end = EndPoints(Curve=item_3)  # -> Start, End
pdecon_2 = Deconstruct(Point=end.Start)  # -> XComponent, YComponent, ZComponent
pdecon_3 = Deconstruct(Point=end.End)  # -> XComponent, YComponent, ZComponent
larger_2 = LargerThan(FirstNumber=pdecon_2.YComponent, SecondNumber=pdecon_3.YComponent)  # -> LargerThan, OrEqualTo
flip = FlipCurve(Curve=item_3)  # -> Curve, Flag
filter_4 = StreamFilter(Gate=larger_2.LargerThan, Stream0=flip.Curve, Stream1=item_3)

evalsrf_5 = EvaluateSurface(Surface=reparameterize(bbox.Box), Point=merge_5)  # -> Point, Normal, UDirection, VDirection, Frame

# ---- group: VAR:
subtraction_2 = Subtraction(A=number_slider_16, B=1)
multiplication_3 = Multiplication(A=subtraction_2, B=Slider(1, range=0.01..1))
time_frame = Data(multiplication_3)

# ---- group: COMP:
hops_2 = Hops(
    Mode=filter_3,
    File=path,
    HMax=number_slider_10,
    ThermConductivity=number_slider_13,
    MassDenssity=number_slider_14,
    Point=evalsrf_5.Point,
    HeatMode=merge_6,
    Temperature=num,
    Step=number_slider_15,
    Count=number_slider_16,
    CacheResultsInMemory=False,
    CacheSolveResults=False,
    RemoteDefinitionLocation="http://127.0.0.1:5000/PDE_2D_Mult",
    RemoteSolveVersion=(0, 1, 0),
    ShowInput_Enabled=False,
    ShowInput_Path=False,
    SynchronousSolve=True)  # -> Time, Vertex, Temp, AverageTemp, QX, QY

# ----
computation_time = Panel(hops_2.Time)
# Formatting Data
panel_15 = Panel("")

split = TextSplit(Text=hops_2.QX, Separators=",")

split_2 = TextSplit(Text=hops_2.Temp, Separators=",")

split_3 = TextSplit(Text=hops_2.QY, Separators=",")

range_2 = Range(Domain=Domain(0, 1), Steps=Slider(10, range=0..10))

time_frame_2 = Data(time_frame)
item_4 = ListItem(List=split_2, Index=time_frame_2, Wrap=True)

time_frame_3 = Data(time_frame)
item_5 = ListItem(List=split, Index=time_frame_3, Wrap=True)

time_frame_4 = Data(time_frame)
item_6 = ListItem(List=split_3, Index=time_frame_4, Wrap=True)

len = Length(Curve=filter_4)
multiplication_4 = Multiplication(A=len, B=Slider(0.05, range=0..0.1))
pcen_2 = PolygonCenter(Polyline=filter_4)  # -> CenterV, CenterE, CenterA
dom_11 = ConstructDomain(DomainStart=expr("x/2", multiplication_4), DomainEnd=expr("-x/2", multiplication_4))
dom_12 = ConstructDomain(DomainStart=expr("x/2", len), DomainEnd=expr("-x/2", len))
rectangle_5 = Rectangle(Plane=pcen_2.CenterE, XSize=dom_11, YSize=dom_12, Radius=0)  # -> Rectangle, Length

num_2 = Number(item_4)
eval_3 = Evaluate(F="round(x,y)", x=num_2, y=Slider(0, range=0..10))

dom_13 = ConstructDomain(DomainStart=temp1, DomainEnd=temp2)
remap_3 = RemapNumbers(Value=eval_3, Source=dom_13, Target=Domain(0, 1))  # -> Mapped, Clipped

vec = VectorXYZ(XComponent=item_5, YComponent=item_6, ZComponent=0)  # -> Vector, Length

graft = GraftTree(Tree=hops_2.Vertex, IncludeEmptyLists=True, IncludeNullItems=True)

remap_4 = RemapNumbers(Value=range_2, Source=Domain(0, 1), Target=dom_13)  # -> Mapped, Clipped
int = Integer(remap_4.Mapped)

# ---- group: VAR:
dom_14 = ConstructDomain(DomainStart=Slider(0, range=0..1), DomainEnd=Slider(0.65, range=0..1))

# ----
remap_5 = RemapNumbers(Value=range_2, Source=Domain(0, 1), Target=dom_14)  # -> Mapped, Clipped
hsl = ColourHSL(Alpha=1, Hue=remap_5.Mapped, Saturation=1, Luminance=0.5)

# ---- group: VAR:
_10º = PowerOf10(Value=Slider(4, range=0..10))
one_over_x = OneOverX(Value=_10º)
multiplication_5 = Multiplication(A=vec.Vector, B=one_over_x, C=Slider(0.26, range=0..1))

# ----
eval_4 = EvaluateCurve(Curve=reparameterize(filter_4), Parameter=range_2)  # -> Point, Tangent, Angle

remap_6 = RemapNumbers(Value=remap_3.Mapped, Source=Domain(0, 1), Target=dom_14)  # -> Mapped, Clipped
hsl_2 = ColourHSL(Alpha=1, Hue=remap_6.Mapped, Saturation=1, Luminance=0.5)

flatten = FlattenTree(Tree=graft, Path="{0}")
flatten_2 = FlattenTree(Tree=hsl_2, Path="{0}")

number_slider_17 = Slider(10, range=0..10)
mplane = MeshPlane(Boundary=rectangle_5.Rectangle, WidthCount=number_slider_17, HeightCount=number_slider_17)  # -> Mesh, Area

X = UnitX(Factor=multiplication_4)
move = Move(Geometry=eval_4.Point, Motion=X)  # -> Geometry, Transform

Z = UnitZ(Factor=remap_3.Mapped)
move_2 = Move(Geometry=graft, Motion=Z)  # -> Geometry, Transform

wires = BrepWireframe(Brep=boundary, Density=-1)
Z_2 = UnitZ(Factor=Slider(0.1, range=0..1))
move_3 = Move(Geometry=wires, Motion=Z_2)  # -> Geometry, Transform

exported_mesh_2 = Geometry(exported_mesh)
wbtriangles = WeaverbirdsSplitTrianglesSubdivision(MeshCurves=exported_mesh_2, Level=Slider(1, range=0..10))

del = DelaunayMesh(Points=flatten(move_2.Geometry), Plane=PlaneXY(0, 0, 0))

# ---- group: VAR:
number_slider_18 = Slider(0.075, range=0.01..0.1)

# ----
contour = Contour(Shape=del, Point=Point(0, 0, 0), Direction=Vector(0, 0, 1), Distance=number_slider_18)  # -> flatten(Contours)
# Plot Legend
panel_18 = Panel("")
# Plot PDE
panel_19 = Panel("")

# ---- group: DISP:
tag = TextTag3D(
    Location=move.Geometry,
    Text=int,
    Size=Slider(0.026, range=0..0.1),
    Colour=ColourSwatch(SwatchColor=RGB(0, 0, 0)),
    Justification=4)

# ----
project = Project(Geometry=contour, Plane=PlaneXY(0, 0, 0))  # -> Geometry, Transform

# ---- group: DISP:
previewlw = CustomPreviewLineweights(
    Geometry=move_3.Geometry,
    Shader=ColourSwatch(SwatchColor=RGB(0, 0, 0)),
    Thickness=Slider(3, range=0..10),
    Absolute=False)

mspray = MeshSpray(Mesh=mplane.Mesh, Points=eval_4.Point, Colours=hsl, SprayMode=0)

mspray_2 = MeshSpray(Mesh=wbtriangles, Points=flatten, Colours=flatten_2, SprayMode=0)

previewlw_2 = CustomPreviewLineweights(
    Geometry=project.Geometry,
    Shader=ColourSwatch(SwatchColor=RGB(255, 255, 255)),
    Thickness=Slider(2, range=0..10),
    Absolute=False)

# ---- group: SUB_DISP:
cloud = CloudDisplay(Points=flatten, Colours=flatten_2, Size=Slider(0.009, range=0..0.1), SpriteType=0)

# ---- group: DISP:
vdisex = VectorDisplayEx(Point=graft, Vector=multiplication_5, Colour=RGB(0, 0, 0), Width=Slider(1, range=0..1))

# ---- group: SUB_DISP:
points = PointList(Points=evalsrf_5.Point, Size=Slider(0.21, range=0..1))

cloud_2 = CloudDisplay(Points=evalsrf_5.Point, Colours=RGB(255, 20, 147), Size=Slider(0.04, range=0..1), SpriteType=0)

# ----
mesh_colored = Geometry(mspray_2)
# Plot Temp Analytics
panel_21 = Panel("")

number_slider_19 = Slider(4, range=0..100)  # disabled
quads = QuadPanels(Surface=rectangle.Rectangle, UDivisions=number_slider_19, VDivisions=number_slider_19)  # disabled

T = Data(split_2)
vertex = Point(hops_2.Vertex)
survey_region = Geometry(<curve referenced from the Rhino model>)
flip_2 = FlipMatrix(Data=T)
incurve = PointInCurve(Point=vertex, Curve=survey_region)  # -> Relationship, Point
dispatch = Dispatch(List=flip_2, DispatchPattern=incurve.Relationship)  # -> ListA, ListB
dispatch_2 = Dispatch(List=vertex, DispatchPattern=incurve.Relationship)  # -> ListA, ListB
num_3 = Number(dispatch.ListA)
geo = Geometry(dispatch_2.ListA)
avr = Average(Input=num_3)  # -> flatten(ArithmeticMean)

t1 = Data(temp1)
t2 = Data(temp2)
avr_2 = Data(hops_2.AverageTemp)
entwine = Entwine(Branch00=t1, Branch01=t2, Branch02=avr_2, Branch03=t1, Branch04=t2, FlattenInputs=True)  # -> flatten(Result)

lng = ListLength(List=avr_2)
subtraction_3 = Subtraction(A=lng, B=1)
series_2 = Series(Start=0, Step=1, Count=subtraction_3)
item_7 = ListItem(List=avr_2, Index=series_2, Wrap=True)  # -> Item, Item1
subtraction_4 = Subtraction(A=item_7.Item1, B=item_7.Item)

lng_2 = ListLength(List=avr)
subtraction_5 = Subtraction(A=lng_2, B=1)
series_3 = Series(Start=0, Step=1, Count=subtraction_5)
item_8 = ListItem(List=avr, Index=series_3, Wrap=True)  # -> Item, Item1
subtraction_6 = Subtraction(A=item_8.Item1, B=item_8.Item)

num_4 = Number(split_2)  # disabled
avr_3 = Average(Input=num_4)  # -> flatten(ArithmeticMean); disabled

incurve_2 = PointInCurve(Point=hops_2.Vertex, Curve=graft(quads))  # -> Relationship, Point; disabled
number_slider_20 = Slider(0, range=0..100)  # disabled
number_slider_21 = Slider(1000, range=0..1000)  # disabled
number_slider_22 = Slider(0.013, range=0..0.1)  # disabled
dispatch_3 = Dispatch(List=avr_3, DispatchPattern=incurve_2.Relationship)  # -> ListA, ListB; disabled
avr_4 = Average(Input=dispatch_3.ListA)  # -> flatten(ArithmeticMean); disabled
bnd = Bounds(Numbers=avr_4)  # disabled
dom_15 = ConstructDomain(DomainStart=number_slider_20, DomainEnd=number_slider_21)  # disabled
number_slider_23 = Slider(1, range=0..10)  # disabled
number_slider_24 = Slider(20, range=0..20)  # disabled
remap_7 = RemapNumbers(Value=avr_4, Source=bnd, Target=Domain(0, 1))  # -> Mapped, Clipped; disabled
neg_12 = Negative(Value=number_slider_22)  # disabled
graph = GraphMapper(
    remap_7.Mapped,
    x0=0,
    x1=1,
    y0=0,
    y1=1,
    container_name="Bezier",
    cpx=[0, 0.6144797802, 1, 1],
    cpy=[0, 0, 0.6991715431, 1])  # disabled
offset_4 = OffsetCurve(Curve=quads, Distance=neg_12, Corners=1)  # disabled
dom_16 = ConstructDomain(DomainStart=number_slider_23, DomainEnd=number_slider_24)  # disabled
remap_8 = RemapNumbers(Value=graph, Source=Domain(0, 1), Target=dom_16)  # -> Mapped, Clipped; disabled
boundary_2 = BoundarySurfaces(Edges=offset_4)  # disabled
wires_2 = BrepWireframe(Brep=quads, Density=-1)  # disabled
popgeo = PopulateGeometry(Geometry=graft(boundary_2), Count=graft(remap_8.Mapped), Seed=1)  # disabled
swatch = ColourSwatch(SwatchColor=RGB(255, 255, 255))  # disabled

# ---- group: DISP:Average Temp per Phase
graph_2 = QuickGraph(entwine, SortOrder=0)

graph_3 = QuickGraph(subtraction_4, SortOrder=0)

# ---- group: DISP:End Temp
graph_4 = QuickGraph(avr, SortOrder=0)

graph_5 = QuickGraph(subtraction_6, SortOrder=0)

# ----
# Plot Graph
panel_22 = Panel("")

geo_2 = Geometry([<curve referenced from the Rhino model> x4])
explode = Explode(Curve=geo_2, Recursive=True)  # -> Segments, Vertices
pcen_3 = PolygonCenter(Polyline=explode.Segments)  # -> CenterV, CenterE, CenterA
pdecon_4 = Deconstruct(Point=pcen_3.CenterE)  # -> XComponent, YComponent, ZComponent
pdecon_5 = Deconstruct(Point=pcen_3.CenterE)  # -> XComponent, YComponent, ZComponent
sort_2 = SortList(Keys=pdecon_4.YComponent, ValuesA=explode.Segments)  # -> Keys, ValuesA
sort_3 = SortList(Keys=pdecon_5.XComponent, ValuesA=explode.Segments)  # -> Keys, ValuesA
item_9 = ListItem(List=sort_2.ValuesA, Index=0, Wrap=True)
item_10 = ListItem(List=sort_3.ValuesA, Index=0, Wrap=True)
swatch_2 = ColourSwatch(SwatchColor=RGB(0, 0, 0))

# ---- group: VAR:
number_slider_25 = Slider(48, range=0..100)

var = Slider(0.5, range=0..1)
number_slider_26 = Slider(0.7, range=0..1)

number_slider_27 = Slider(300, range=0..1000)

# ----
dom_17 = ConstructDomain(DomainStart=0, DomainEnd=number_slider_27)
remap_9 = RemapNumbers(Value=subtraction_4, Source=dom_17, Target=Domain(0, 1))  # -> Mapped, Clipped

range_3 = Range(Domain=Domain(0, 1), Steps=expr("x-1", number_slider_16))
pt = ConstructPoint(XCoordinate=range_3, YCoordinate=remap_9.Mapped, ZCoordinate=0)
geo_3 = Geometry(<curve referenced from the Rhino model>)
evalsrf_6 = EvaluateSurface(Surface=reparameterize(geo_3), Point=pt)  # -> Point, Normal, UDirection, VDirection, Frame

dom_18 = ConstructDomain(DomainStart=0, DomainEnd=number_slider_25)
remap_10 = RemapNumbers(Value=subtraction_6, Source=dom_18, Target=Domain(0, 1))  # -> Mapped, Clipped

range_4 = Range(Domain=Domain(0, 1), Steps=expr("x-1", number_slider_16))
pt_2 = ConstructPoint(XCoordinate=range_4, YCoordinate=remap_10.Mapped, ZCoordinate=0)
geo_4 = Geometry(<curve referenced from the Rhino model>)
evalsrf_7 = EvaluateSurface(Surface=reparameterize(geo_4), Point=pt_2)  # -> Point, Normal, UDirection, VDirection, Frame

dom_19 = ConstructDomain(DomainStart=var, DomainEnd=number_slider_26)
animate_2 = Data(animate)
remap_11 = RemapNumbers(Value=animate_2, Source=dom_19, Target=Domain(0, 1))  # -> Mapped, Clipped
hsl_3 = ColourHSL(Alpha=1, Hue=remap_11.Mapped, Saturation=1, Luminance=0.5)
color = Data(hsl_3)

t2_2 = Data(temp2)
t1_2 = Data(temp1)
avr_5 = Data(hops_2.AverageTemp)
dom_20 = ConstructDomain(DomainStart=t2_2, DomainEnd=t1_2)
remap_12 = RemapNumbers(Value=avr_5, Source=dom_20, Target=Domain(0, 1))  # -> Mapped, Clipped

range_5 = Range(Domain=Domain(0, 1), Steps=expr("x-1", number_slider_16))
pt_3 = ConstructPoint(XCoordinate=range_5, YCoordinate=remap_12.Mapped, ZCoordinate=0)
geo_5 = Geometry(<curve referenced from the Rhino model>)
evalsrf_8 = EvaluateSurface(Surface=reparameterize(geo_5), Point=pt_3)  # -> Point, Normal, UDirection, VDirection, Frame

t1_3 = Data(temp1)
t2_3 = Data(temp2)
dom_21 = ConstructDomain(DomainStart=t2_3, DomainEnd=t1_3)
remap_13 = RemapNumbers(Value=avr, Source=dom_21, Target=Domain(0, 1))  # -> Mapped, Clipped

range_6 = Range(Domain=Domain(0, 1), Steps=expr("x-1", number_slider_16))
pt_4 = ConstructPoint(XCoordinate=range_6, YCoordinate=remap_13.Mapped, ZCoordinate=0)
geo_6 = Geometry(<curve referenced from the Rhino model>)
evalsrf_9 = EvaluateSurface(Surface=reparameterize(geo_6), Point=pt_4)  # -> Point, Normal, UDirection, VDirection, Frame

pline = PolyLine(Vertices=evalsrf_7.Point, Closed=False)
pline_2 = PolyLine(Vertices=evalsrf_8.Point, Closed=False)
pline_3 = PolyLine(Vertices=evalsrf_6.Point, Closed=False)
pline_4 = PolyLine(Vertices=evalsrf_9.Point, Closed=False)

number_slider_28 = Slider(0.06, range=0..1)  # disabled
swatch_3 = ColourSwatch(SwatchColor=RGB(191, 191, 191))  # disabled
cloud_3 = CloudDisplay(Points=popgeo, Colours=swatch, Size=number_slider_28, SpriteType=0)  # disabled

number_slider_29 = Slider(4, range=0..10)  # disabled
previewlw_3 = CustomPreviewLineweights(Geometry=wires_2, Shader=swatch, Thickness=number_slider_29, Absolute=False)  # disabled

# ---- group: DISP:
number_slider_30 = Slider(3, range=0..10)

# ---- group: DISP_POST:
previewlw_4 = CustomPreviewLineweights(Geometry=item_9, Shader=swatch_2, Absolute=False)
previewlw_5 = CustomPreviewLineweights(Geometry=item_10, Shader=swatch_2, Absolute=False)

previewlw_6 = CustomPreviewLineweights(Geometry=pline_2, Shader=color, Thickness=number_slider_30, Absolute=False)
previewlw_7 = CustomPreviewLineweights(Geometry=pline_3, Shader=color, Thickness=number_slider_30, Absolute=False)
previewlw_8 = CustomPreviewLineweights(Geometry=pline_4, Shader=color, Thickness=number_slider_30, Absolute=False)
previewlw_9 = CustomPreviewLineweights(Geometry=pline, Shader=color, Thickness=number_slider_30, Absolute=False)

# ----
# Bake Graph
panel_26 = Panel("")
# Bake Mesh
panel_27 = Panel("")

# ---- group: VAR:
falsestart = LBFalseStartToggle(False)  # disabled
bake = Data(falsestart)  # disabled

panel_28 = Panel("Matlab PDE 2D Mesh")  # disabled
layers = CreateModifyLayers(LayerName=panel_28, DeleteLayer=False, enableFullPath=False)  # -> LayerNames, LayerFullPath; disabled
pde_2d_mesh_layer = Data(layers.LayerNames)  # disabled

panel_29 = Panel("Matlab PDE 2D Graph")  # disabled
layers_2 = CreateModifyLayers(LayerName=panel_29, DeleteLayer=False, enableFullPath=False)  # -> LayerNames, LayerFullPath; disabled
pde_2d_graph_layer = Data(layers_2.LayerNames)  # disabled

# ----
neg_13 = Negative(Value=Slider(45, range=0..100))
Z_3 = UnitZ(Factor=neg_13)
disc = Discontinuity(Curve=rectangle.Rectangle, Level=1)  # -> Points, Parameters
supp = SupportKaramba3D(PosInd=disc.Points, menu=[buttons(on, on, on, off, off, off)])
loads = LoadsKaramba3D(Vector=Z_3, LCase=0, mode="Gravity")
demesh = DeconstructMesh(Mesh=exported_mesh)  # -> Vertices, Faces, Colours, Normals

flatten_3 = FlattenTree(Tree=vec.Vector, Path="{0}")
flatten_4 = FlattenTree(Tree=graft, Path="{0}")

meshtoshell = MeshToShellKaramba3D(Mesh=exported_mesh, LimitDistance_m=0.005)  # -> Element, Points, Info
cp = ClosestPoint(Point=graft(demesh.Vertices), Cloud=flatten_4)  # -> ClosestPoint, flatten(CPIndex), Distance
assemble = AssembleModelKaramba3D(Elem=meshtoshell.Element, Support=supp, Load=loads, LimitDistance_m=0.005)  # -> Model, Info, Mass_kg, CenterOfGravity
item_11 = ListItem(List=flatten_3, Index=cp.CPIndex, Wrap=True)
item_12 = ListItem(List=flatten_4, Index=cp.CPIndex, Wrap=True)

# ---- group: OUT:
W_2 = Data(W)  # disabled
H_2 = Data(H)  # disabled
mesh_colored_2 = Geometry(mesh_colored)
pde_2d_mesh_layer_2 = Data(pde_2d_mesh_layer)  # disabled
name = Data(objectname)  # disabled
panel_30 = Panel("""W
H
O""")  # disabled
panel_31 = Panel("PDE 2D Mesh")  # disabled
entwine_2 = Entwine(Branch00=W_2, Branch01=H_2, Branch02=panel_31, FlattenInputs=True)  # -> flatten(Result); disabled
bake_2 = Data(bake)  # disabled
createatts = CreateAttributes(Name=name, LayerName=pde_2d_mesh_layer_2, UserDataKeys=panel_30, UserDataValues=entwine_2, enableFullPath=False)  # disabled
bake_3 = BakeGeometry(Bake=bake_2, Geometry=mesh_colored_2, Attributes=createatts, DeleteOldBakes=False, PreserveTrees=False)  # disabled

bake_4 = Data(bake)  # disabled
W_3 = Data(W)  # disabled
H_3 = Data(H)  # disabled
name_2 = Data(objectname)  # disabled
pde_2d_graph_layer_2 = Data(pde_2d_graph_layer)  # disabled
color_2 = Data(color)  # disabled
panel_32 = Panel("PDE 2D AVR Temp")  # disabled
entwine_3 = Entwine(Branch00=W_3, Branch01=H_3, Branch02=panel_32, FlattenInputs=True)  # -> flatten(Result); disabled
createatts_2 = CreateAttributes(
    Name=name_2,
    LayerName=pde_2d_graph_layer_2,
    Color=color_2,
    UserDataKeys=panel_30,
    UserDataValues=entwine_3,
    enableFullPath=False)  # disabled
bake_5 = BakeGeometry(Bake=bake_4, Geometry=pline_2, Attributes=createatts_2, DeleteOldBakes=False, PreserveTrees=False)  # disabled

W_4 = Data(W)  # disabled
H_4 = Data(H)  # disabled
bake_6 = Data(bake)  # disabled
pde_2d_graph_layer_3 = Data(pde_2d_graph_layer)  # disabled
name_3 = Data(objectname)  # disabled
color_3 = Data(color)  # disabled
panel_33 = Panel("PDE 2D E2 Temp")  # disabled
entwine_4 = Entwine(Branch00=W_4, Branch01=H_4, Branch02=panel_33, FlattenInputs=True)  # -> flatten(Result); disabled
createatts_3 = CreateAttributes(
    Name=name_3,
    LayerName=pde_2d_graph_layer_3,
    Color=color_3,
    UserDataKeys=panel_30,
    UserDataValues=entwine_4,
    enableFullPath=False)  # disabled
bake_7 = BakeGeometry(Bake=bake_6, Geometry=pline_4, Attributes=createatts_3, DeleteOldBakes=False, PreserveTrees=False)  # disabled

W_5 = Data(W)  # disabled
H_5 = Data(H)  # disabled
pde_2d_graph_layer_4 = Data(pde_2d_graph_layer)  # disabled
name_4 = Data(objectname)  # disabled
color_4 = Data(color)  # disabled
panel_34 = Panel("PDE 2D AVR Temp Dif")  # disabled
entwine_5 = Entwine(Branch00=W_5, Branch01=H_5, Branch02=panel_34, FlattenInputs=True)  # -> flatten(Result); disabled
bake_8 = Data(bake)  # disabled
createatts_4 = CreateAttributes(
    Name=name_4,
    LayerName=pde_2d_graph_layer_4,
    Color=color_4,
    UserDataKeys=panel_30,
    UserDataValues=entwine_5,
    enableFullPath=False)  # disabled
bake_9 = BakeGeometry(Bake=bake_8, Geometry=pline_3, Attributes=createatts_4, DeleteOldBakes=False, PreserveTrees=False)  # disabled

W_6 = Data(W)  # disabled
H_6 = Data(H)  # disabled
pde_2d_graph_layer_5 = Data(pde_2d_graph_layer)  # disabled
name_5 = Data(objectname)  # disabled
color_5 = Data(color)  # disabled
panel_35 = Panel("PDE 2D E2 Temp Dif")  # disabled
entwine_6 = Entwine(Branch00=W_6, Branch01=H_6, Branch02=panel_35, FlattenInputs=True)  # -> flatten(Result); disabled
bake_10 = Data(bake)  # disabled
createatts_5 = CreateAttributes(
    Name=name_5,
    LayerName=pde_2d_graph_layer_5,
    Color=color_5,
    UserDataKeys=panel_30,
    UserDataValues=entwine_6,
    enableFullPath=False)  # disabled
bake_11 = BakeGeometry(Bake=bake_10, Geometry=pline, Attributes=createatts_5, DeleteOldBakes=False, PreserveTrees=False)  # disabled

# ----
license = LicenseKaramba3D()  # disabled
number_slider_31 = Slider(7.98, range=0..20)  # disabled
analyze = AnalyzeKaramba3D(Model=assemble.Model)  # -> CalculatedModel, MaximumDisplacement_cm, ResultingForceOfGravity_kN, ElasticEnergy_kNm

rad = Radians(Degrees=Slider(0, range=0..360))
Z_4 = UnitZ(Factor=1)
vrot = Rotate(Vector=item_11, Axis=Z_4, Angle=rad)

del_2 = DelaunayMesh(Points=flatten([popgeo, disc.Points]), Plane=PlaneXY(0, 0, 0))  # disabled
emodes = EigenModesKaramba3D(Model=assemble.Model, FromIndex=1, NumberOfModes=1, MaximumNumberOfIterations=300, Epsilon=1e-07)  # -> ModelWithEigenModesAsLoadCaseResults, Eigenvalues; disabled
con = DelaunayEdges(Points=flatten([popgeo, disc.Points]), Plane=PlaneXY(0, 0, 0))  # -> Connectivity, Edges; disabled
number_slider_32 = Slider(0.02, range=0..1)  # disabled
toggle = BooleanToggle(False)  # disabled
wbframe = WeaverbirdsPictureFrame(MeshPolylines=del_2, Distance=number_slider_31, InsetType=toggle)  # disabled
modelview = ModelViewKaramba3D(Model=analyze.CalculatedModel, ResultFactors=1, ResultCase=-1)  # -> Model, DeformedMesh, DeformedAxes, DeformedModel; disabled
# Reference Data
panel_37 = Panel("")
number_slider_33 = Slider(0.5, range=0..10)  # disabled
wbthicken = WeaverbirdsMeshThicken(MeshCurves=wbframe, Distance=number_slider_32, OffsetType=0)  # disabled
swatch_4 = ColourSwatch(SwatchColor=RGB(133, 133, 133))  # disabled

# ---- group: VAR:
toggle_2 = FalseStartToggle(False)

# ----
shellview = ShellViewKaramba3D(Model=modelview.Model, IndexOfLayer=0)  # -> Model, MeshesOfRenderedShells, LegendColors, LegendTags; disabled
f_cmwd = CustomMeshWiresDisplay(Mesh=wbthicken, Color=swatch_4, Width=number_slider_33)  # disabled
f_ghfilepath = GHFilePathInfo()  # -> FileName, FilePath; disabled
toggle_3 = BooleanToggle(False)  # disabled

number_slider_34 = Slider(100, range=0..100)  # disabled
scale = Scale(Geometry=wbthicken, Center=Point(0, 0, 0), Factor=number_slider_34)  # -> Geometry, Transform; disabled
clean = CombineClean(Meshes=scale.Geometry)  # disabled

f_nv2c4d = NamedViewsToCinema4D(Update=toggle_3)  # disabled
userstreamlines = UserStreamLinesKaramba3D(
    Model=analyze.CalculatedModel,
    TangentVectors=vrot,
    ListOfSourcesOfStreamLinesLinesPoints=item_12,
    SegmentLength=Slider(0.01, range=0..1),
    DA=Slider(1, range=0..90))  # -> Model, Lines
panel_38 = Panel(f_nv2c4d)  # disabled
move_4 = Move(Geometry=userstreamlines.Lines, Motion=Vector(0, 0, 10))  # -> Geometry, Transform
Z_5 = UnitZ(Factor=1)
previewlw_10 = CustomPreviewLineweights(
    Geometry=move_4.Geometry,
    Shader=ColourSwatch(SwatchColor=RGB(59, 59, 59)),
    Thickness=Slider(0, range=0..10),
    Absolute=False)
# Sort Data
panel_40 = Panel("")
# Plot Graph
panel_42 = Panel("")

number_slider_35 = Slider(0.1, range=0..1)  # disabled
number_slider_36 = Slider(1, range=0..1)  # disabled
subtraction_7 = Subtraction(A=number_slider_36, B=number_slider_35)  # disabled

scale_factor = Slider(0.012, range=0..0.1)  # disabled
number_slider_37 = Slider(0.008, range=0..0.1)  # disabled
dom_22 = ConstructDomain(DomainStart=number_slider_35, DomainEnd=subtraction_7)  # disabled

number_slider_38 = Slider(2, range=0..10)  # disabled
swatch_5 = ColourSwatch(SwatchColor=RGB(0, 0, 0))  # disabled

# ----
# Plot Graph
panel_44 = Panel("")
# Plot Graph
panel_46 = Panel("")

groups = GetGroups()  # -> Groups, GroupStyles, Nickname, Color

len_2 = TextLength(Text=groups.Nickname)
txt = Text(len_2)
mindex = MemberIndex(Set=txt, Member="0")  # -> Index, Count
replace = ReplaceItems(List=groups.Nickname, Item="<empty>", Indices=mindex.Index, Wrap=False)

panel_48 = Panel("""<empty>
VAR:
DISP:
SUB_DISP:
DISP_POST:
OUT:
COMP:""")
python = GhPythonScript(group_names=replace, search_name=panel_48)  # -> found_name; inputs group_names: list
# ---------- python: Python ----------
found_name=[]
for name in group_names:
    found = name.find(search_name)
    if found==0:
        found = 1
    else:
        found = 0
    found_name.append(found)
# ---------- end python ----------

python_2 = GhPythonScript(group_names=replace, search_name="DISP:")  # -> found_name; inputs group_names: list; same code as python

flip_3 = FlipMatrix(Data=python)
ma = MassAddition(Input=flip_3)  # -> flatten(Result), PartialResults

dispatch_4 = Dispatch(List=groups.Groups, DispatchPattern=python_2)  # -> ListA, ListB
dispatch_5 = Dispatch(List=groups.Groups, DispatchPattern=python)  # -> ListA, ListB
dispatch_6 = Dispatch(List=groups.Groups, DispatchPattern=ma.Result)  # -> ListA, ListB
objfromgroup = GetObjectsInGroup(Group=dispatch_4.ListA)
# Dependecies: Python
# Python-Numpy
# Python-rhino3dm
# Python-Matlab Engine
# Hops
# Metahopper
# Human
# Pancake
# Matlab
# Matlab PDE
# Matlab Symunits
hideshow = HideShowObjectPreview(Objects=objfromgroup, Visible=Toggle(True))
setgroup = SetGroupProperties(Group=dispatch_5.ListA, Color=merge)
# Matlab to Grasshopper
setgroup_2 = SetGroupProperties(Group=dispatch_6.ListB, Color=ColourSwatch(SwatchColor=RGB(255, 132, 0)))

# ---- group: COMP:
pde_2d_graph_layer_6 = Data(pde_2d_graph_layer)  # disabled
pde_2d_mesh_layer_3 = Data(pde_2d_mesh_layer)  # disabled

panel_49 = Panel("mesh")  # disabled
dpipeline = DynamicGeometryPipeline(
    LayerFilter=pde_2d_mesh_layer_3,
    TypeFilter=panel_49,
    NameFilter="*",
    GroupByLayer=False,
    GroupByType=False,
    IncludeHidden=True,
    IncludeLocked=True,
    enableFullPath=False,
    listenToAttributes=True)  # disabled

panel_50 = Panel("curve")  # disabled
dpipeline_2 = DynamicGeometryPipeline(
    LayerFilter=pde_2d_graph_layer_6,
    TypeFilter=panel_50,
    NameFilter="*",
    GroupByLayer=False,
    GroupByType=False,
    IncludeHidden=True,
    IncludeLocked=True,
    enableFullPath=False,
    listenToAttributes=True)  # disabled

filter_5 = StreamFilter(Gate=toggle_2, Stream1=dpipeline)
filter_6 = StreamFilter(Gate=toggle_2, Stream1=dpipeline_2)
objatts = ObjectAttributes(ObjectOrAttributes=filter_5)  # -> Name, LayerName, LayerFullPath, Color, MaterialName, LinetypeName, GroupIndices, PlotWeight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; disabled
objatts_2 = ObjectAttributes(ObjectOrAttributes=filter_6)  # -> Name, LayerName, LayerFullPath, Color, MaterialName, LinetypeName, GroupIndices, PlotWeight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; disabled
tsort = SortText(Keys=objatts.Name, Values=filter_5, Culture=127)  # -> Keys, Values; disabled
tsort_2 = SortText(Keys=objatts_2.Name, Values=filter_6, Culture=127)  # -> Keys, Values; disabled

# ----
graft_2 = GraftTree(Tree=tsort_2.Values, IncludeEmptyLists=True, IncludeNullItems=True)  # disabled
objatts_3 = ObjectAttributes(ObjectOrAttributes=graft_2)  # -> Name, LayerName, LayerFullPath, Color, MaterialName, LinetypeName, GroupIndices, PlotWeight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; disabled

panel_51 = Panel("O")  # disabled
mindex_2 = MemberIndex(Set=objatts_3.UserDataKeys, Member=panel_51)  # -> Index, Count; disabled

item_13 = ListItem(List=objatts_3.UserDataValues, Index=mindex_2.Index, Wrap=True)  # disabled
cset = CreateSet(List=flatten(item_13))  # -> Set, Map; disabled
list_14 = ItemSelector(cset.Set, {"PDE 2D AVR Temp", "PDE 2D E2 Temp Dif", "PDE 2D AVR Temp Dif", "PDE 2D E2 Temp"}, selected="PDE 2D AVR Temp")  # disabled
mindex_3 = MemberIndex(Set=item_13, Member=list_14)  # -> Index, Count; disabled

item_14 = ListItem(List=graft_2, Index=mindex_3.Index, Wrap=True)  # -> flatten(Item); disabled

end_2 = EndPoints(Curve=item_14)  # -> Start, End; disabled
pdecon_6 = Deconstruct(Point=end_2.End)  # -> XComponent, YComponent, ZComponent; disabled

area_3 = Area(Geometry=tsort.Values)  # -> Area, Centroid; disabled
sort_4 = SortList(Keys=area_3.Area, ValuesTemp=pdecon_6.YComponent, ValuesArea=area_3.Area, ValuesMesh=tsort.Values)  # -> Keys, ValuesTemp, ValuesArea, ValuesMesh; disabled
sort_5 = SortList(Keys=pdecon_6.YComponent, ValuesTemp=pdecon_6.YComponent, ValuesArea=area_3.Area, ValuesMesh=tsort.Values)  # -> Keys, ValuesTemp, ValuesArea, ValuesMesh; disabled

bnd_2 = Bounds(Numbers=flatten(sort_4.ValuesArea))  # disabled
remap_14 = RemapNumbers(Value=sort_4.ValuesArea, Source=bnd_2, Target=Domain(0, 1))  # -> Mapped, Clipped; disabled

bnd_3 = Bounds(Numbers=flatten(sort_4.ValuesTemp))  # disabled
remap_15 = RemapNumbers(Value=sort_4.ValuesTemp, Source=bnd_3, Target=dom_22)  # -> Mapped, Clipped; disabled

bnd_4 = Bounds(Numbers=flatten(sort_5.ValuesTemp))  # disabled
remap_16 = RemapNumbers(Value=sort_5.ValuesTemp, Source=bnd_4, Target=Domain(0, 1))  # -> Mapped, Clipped; disabled

bnd_5 = Bounds(Numbers=flatten(sort_5.ValuesArea))  # disabled
remap_17 = RemapNumbers(Value=sort_5.ValuesArea, Source=bnd_5, Target=dom_22)  # -> Mapped, Clipped; disabled

pt_5 = ConstructPoint(XCoordinate=remap_14.Mapped, YCoordinate=remap_15.Mapped, ZCoordinate=0)  # disabled
geo_7 = Geometry(<curve referenced from the Rhino model>)  # disabled
evalsrf_10 = EvaluateSurface(Surface=reparameterize(geo_7), Point=pt_5)  # -> Point, Normal, UDirection, VDirection, Frame; disabled

pt_6 = ConstructPoint(XCoordinate=remap_16.Mapped, YCoordinate=remap_17.Mapped, ZCoordinate=0)  # disabled
geo_8 = Geometry(<curve referenced from the Rhino model>)  # disabled
evalsrf_11 = EvaluateSurface(Surface=reparameterize(geo_8), Point=pt_6)  # -> Point, Normal, UDirection, VDirection, Frame; disabled

scale_2 = Scale(Geometry=sort_4.ValuesMesh, Center=Point(0, 0, 0), Factor=scale_factor)  # -> Geometry, Transform; disabled
Y = UnitY(Factor=number_slider_37)  # disabled
move_5 = Move(Geometry=evalsrf_10.Point, Motion=Y)  # -> Geometry, Transform; disabled
orient = Orient(Geometry=scale_2.Geometry, Source=PlaneXY(0, 0, 0), Target=move_5.Geometry)  # -> Geometry, Transform; disabled

scale_3 = Scale(Geometry=sort_5.ValuesMesh, Center=Point(0, 0, 0), Factor=scale_factor)  # -> Geometry, Transform; disabled
Y_2 = UnitY(Factor=number_slider_37)  # disabled
move_6 = Move(Geometry=evalsrf_11.Point, Motion=Y_2)  # -> Geometry, Transform; disabled
orient_2 = Orient(Geometry=scale_3.Geometry, Source=PlaneXY(0, 0, 0), Target=move_6.Geometry)  # -> Geometry, Transform; disabled

pline_5 = PolyLine(Vertices=evalsrf_10.Point, Closed=False)  # disabled
pline_6 = PolyLine(Vertices=evalsrf_11.Point, Closed=False)  # disabled

# ---- group: DISP_POST:
previewlw_11 = CustomPreviewLineweights(Geometry=pline_5, Shader=swatch_5, Thickness=number_slider_38, Absolute=False)  # disabled
previewlw_12 = CustomPreviewLineweights(Geometry=pline_6, Shader=swatch_5, Thickness=number_slider_38, Absolute=False)  # disabled

# ----
graft_3 = GraftTree(Tree=orient_2.Geometry, IncludeEmptyLists=True, IncludeNullItems=True)  # disabled
number_slider_39 = Slider(10, range=0..10)  # disabled
number_slider_40 = Slider(100, range=0..100)  # disabled
lng_3 = ListLength(List=flatten(graft_3))  # disabled
series_4 = Series(Start=number_slider_39, Step=number_slider_39, Count=lng_3)  # -> graft(Series); disabled
Z_6 = UnitZ(Factor=series_4)  # disabled
Z_7 = UnitZ(Factor=number_slider_40)  # disabled
move_7 = Move(Geometry=graft_3, Motion=Z_6)  # -> Geometry, Transform; disabled
medges = MeshEdges(Mesh=move_7.Geometry)  # -> NakedEdges, InteriorEdges, NonManifoldEdges; disabled
merge_7 = Merge(Data1=medges.NakedEdges, Data2=medges.NonManifoldEdges)  # disabled

graft_4 = GraftTree(Tree=orient.Geometry, IncludeEmptyLists=True, IncludeNullItems=True)  # disabled
number_slider_41 = Slider(10, range=0..10)  # disabled
number_slider_42 = Slider(100, range=0..100)  # disabled
lng_4 = ListLength(List=flatten(graft_4))  # disabled
series_5 = Series(Start=number_slider_41, Step=number_slider_41, Count=lng_4)  # -> graft(Series); disabled
Z_8 = UnitZ(Factor=series_5)  # disabled
Z_9 = UnitZ(Factor=number_slider_42)  # disabled
move_8 = Move(Geometry=graft_4, Motion=Z_8)  # -> Geometry, Transform; disabled
medges_2 = MeshEdges(Mesh=move_8.Geometry)  # -> NakedEdges, InteriorEdges, NonManifoldEdges; disabled
merge_8 = Merge(Data1=medges_2.NakedEdges, Data2=medges_2.NonManifoldEdges)  # disabled

# ---- group: DISP_POST:
swatch_6 = ColourSwatch(SwatchColor=RGB(0, 0, 0))  # disabled
previewlw_13 = CustomPreviewLineweights(Geometry=merge_7, Shader=swatch_6, Absolute=False)  # disabled
geo_9 = Geometry(move_7.Geometry)  # disabled

swatch_7 = ColourSwatch(SwatchColor=RGB(0, 0, 0))  # disabled
previewlw_14 = CustomPreviewLineweights(Geometry=merge_8, Shader=swatch_7, Absolute=False)  # disabled
geo_10 = Geometry(move_8.Geometry)  # disabled

# ----
explode_2 = Explode(Curve=geo_8, Recursive=True)  # -> Segments, Vertices; disabled
pcen_4 = PolygonCenter(Polyline=explode_2.Segments)  # -> CenterV, CenterE, CenterA; disabled
pdecon_7 = Deconstruct(Point=pcen_4.CenterE)  # -> XComponent, YComponent, ZComponent; disabled
pdecon_8 = Deconstruct(Point=pcen_4.CenterE)  # -> XComponent, YComponent, ZComponent; disabled
sort_6 = SortList(Keys=pdecon_7.YComponent, ValuesA=explode_2.Segments)  # -> Keys, ValuesA; disabled
sort_7 = SortList(Keys=pdecon_8.XComponent, ValuesA=explode_2.Segments)  # -> Keys, ValuesA; disabled
item_15 = ListItem(List=sort_6.ValuesA, Index=0, Wrap=True)  # disabled
item_16 = ListItem(List=sort_7.ValuesA, Index=0, Wrap=True)  # disabled

explode_3 = Explode(Curve=geo_7, Recursive=True)  # -> Segments, Vertices; disabled
pcen_5 = PolygonCenter(Polyline=explode_3.Segments)  # -> CenterV, CenterE, CenterA; disabled
pdecon_9 = Deconstruct(Point=pcen_5.CenterE)  # -> XComponent, YComponent, ZComponent; disabled
pdecon_10 = Deconstruct(Point=pcen_5.CenterE)  # -> XComponent, YComponent, ZComponent; disabled
sort_8 = SortList(Keys=pdecon_9.YComponent, ValuesA=explode_3.Segments)  # -> Keys, ValuesA; disabled
sort_9 = SortList(Keys=pdecon_10.XComponent, ValuesA=explode_3.Segments)  # -> Keys, ValuesA; disabled
item_17 = ListItem(List=sort_8.ValuesA, Index=0, Wrap=True)  # disabled
item_18 = ListItem(List=sort_9.ValuesA, Index=0, Wrap=True)  # disabled

# ---- group: DISP_POST:
swatch_8 = ColourSwatch(SwatchColor=RGB(0, 0, 0))  # disabled
previewlw_15 = CustomPreviewLineweights(Geometry=item_15, Shader=swatch_8, Absolute=False)  # disabled
previewlw_16 = CustomPreviewLineweights(Geometry=item_16, Shader=swatch_8, Absolute=False)  # disabled

swatch_9 = ColourSwatch(SwatchColor=RGB(0, 0, 0))  # disabled
previewlw_17 = CustomPreviewLineweights(Geometry=item_17, Shader=swatch_9, Absolute=False)  # disabled
previewlw_18 = CustomPreviewLineweights(Geometry=item_18, Shader=swatch_9, Absolute=False)  # disabled
