# Grasshopper definition matlab_hops_PDE_3D.gh (Grasshopper 1.0.7)
# plug-ins: Hops, Kangaroo2 Components, Kangaroo Components, MeshEdit Components, Pancake, Human, MetaHopper, FalseStartToggle, LadybugGrasshopper

# Parameter Generator
panel = Panel("")

# ---- group: COMP:Iteration Get
number_slider = Slider(1, range=0..1)

# ---- group: COMP:Iteration Amount
# Use this method to Iterate
number_slider_2 = Slider(10, range=0..10)

# ----
sqr = Square(Value=number_slider_2)
max_numb = Panel(sqr)
subtraction = Subtraction(A=sqr, B=1)
multiplication = Multiplication(A=number_slider, B=subtraction)

remap = RemapNumbers(Value=multiplication, Source=subtraction, Target=Domain(0, 1))  # -> Mapped, Clipped
animate = Data(remap.Mapped)

merge = Merge(
    Data1=ColourSwatch(SwatchColor=RGB(255, 255, 255)),
    Data2=ColourSwatch(SwatchColor=RGB(255, 0, 0)),
    Data3=ColourSwatch(SwatchColor=RGB(213, 0, 255)),
    Data4=ColourSwatch(SwatchColor=RGB(106, 0, 255)),
    Data5=ColourSwatch(SwatchColor=RGB(255, 0, 255)),
    Data6=ColourSwatch(SwatchColor=RGB(255, 251, 0)),
    Data7=ColourSwatch(SwatchColor=RGB(0, 136, 255)))  # -> graft(Result)

# ----
# PDE 3D
# Geometry Generator
panel_4 = Panel("")

# ---- group: VAR:
number_slider_3 = Slider(0.28, range=0..1)
number_slider_4 = Slider(0.12, range=0..0.2)
number_slider_5 = Slider(1, range=0..10)
number_slider_6 = Slider(20, range=0..100)
number_slider_7 = Slider(45, range=0..90)

number_slider_8 = Slider(0.2, range=0..1)
number_slider_9 = Slider(0.2, range=0..1)
number_slider_10 = Slider(45, range=0..90)

number_slider_11 = Slider(1, range=0..1)
number_slider_12 = Slider(1, range=0..1)
number_slider_13 = Slider(0.15, range=0..1)

# ----
division = Division(A=number_slider_11, B=2)
neg = Negative(Value=division)
dom = ConstructDomain(DomainStart=division, DomainEnd=neg)

division_2 = Division(A=number_slider_12, B=2)
neg_2 = Negative(Value=division_2)
dom_2 = ConstructDomain(DomainStart=division_2, DomainEnd=neg_2)

box = CenterBox(Base=PlaneXY(0, 0, 0), X=division, Y=division_2, Z=number_slider_13)

division_3 = Division(A=number_slider_8, B=2)
neg_3 = Negative(Value=division_3)
dom_3 = ConstructDomain(DomainStart=division_3, DomainEnd=neg_3)

division_4 = Division(A=number_slider_9, B=2)
neg_4 = Negative(Value=division_4)
dom_4 = ConstructDomain(DomainStart=division_4, DomainEnd=neg_4)

geo = Geometry(box)
rectangle = Rectangle(Plane=PlaneXY(0, 0, 0), XSize=dom, YSize=dom_2, Radius=0)  # -> Rectangle, Length

neg_5 = Negative(Value=number_slider_3)
offset = OffsetCurve(Curve=rectangle.Rectangle, Distance=neg_5, Corners=1)
sdivide = DivideSurface(Surface=offset, UCount=number_slider_5, VCount=number_slider_5)  # -> Points, Normals, Parameters

polygon = Polygon(Plane=sdivide.Points, Radius=number_slider_4, Segments=number_slider_6, FilletRadius=0)  # -> Polygon, Length
rotate = Rotate(Geometry=polygon.Polygon, Angle=degrees(number_slider_7), Plane=sdivide.Points)  # -> flatten(Geometry), Transform

rectangle_2 = Rectangle(Plane=sdivide.Points, XSize=dom_3, YSize=dom_4, Radius=0)  # -> Rectangle, Length
rotate_2 = Rotate(Geometry=rectangle_2.Rectangle, Angle=degrees(number_slider_10), Plane=sdivide.Points)  # -> flatten(Geometry), Transform

merge_2 = Merge(Data1=rectangle.Rectangle, Data2=rotate.Geometry)  # -> flatten(Result)
Z = UnitZ(Factor=number_slider_13)
boundary = BoundarySurfaces(Edges=merge_2)
extr = Extrude(Base=boundary, Direction=Z)

# ---- group: OUT:
bake = BakeGeometry(Bake=Button(), Geometry=extr, DeleteOldBakes=False, PreserveTrees=False)

# ----
# Mesh
panel_5 = Panel("")

# ---- group: VAR:
number_slider_14 = Slider(0.03, range=0..0.2)
number_slider_15 = Slider(0.08, range=0..0.2)

# ----
work_dir = WorkingDirectory()  # -> folder_name, file_name; inputs run: Boolean
# ---------- work_dir: Python ----------
dir = ghenv.Component.OnPingDocument().FilePath
                
if run:
    file_name = dir
else:
    file_name = dir
    
    
dash = '\\'

sp = file_name.split(dash)

folder_name = file_name.replace(sp[-1],"")
# ---------- end work_dir ----------

# ---- group: VAR:
sub_directory = Panel("3d\")
stl_file_name = Panel("volume.stl")
concat = Concatenate(FragmentC=work_dir.folder_name, FragmentA=sub_directory, FragmentB=stl_file_name)

# ---- group: COMP:
custom_mesh_settings = SettingsCustom(
    StitchSeams=True,
    SimplePlanes=False,
    Refine=True,
    MinCount=16,
    MaxCount=400,
    AspectRatio=20,
    MaxDistance=0,
    MaxAngle=20,
    MinEdge=number_slider_14,
    MaxEdge=number_slider_15)
mesh = MeshBrep(Brep=extr, Settings=custom_mesh_settings)

triremesh = TriRemesh(Geometry=mesh, Sharp=Toggle(True), Length=number_slider_15, Iterations=Slider(20, range=0..100))  # -> Triangulation, Dual, Creases

# ----
bbox = BoundingBox(Content=extr, Plane=PlaneXY(0, 0, 0))  # -> flatten(Box), Box_2

md_slider = MDSlider(
    SliderMode=0,
    slider_value=Point(0, 0.49609375, 0.5),
    x_domain=Domain(0, 1),
    y_domain=Domain(0, 1),
    z_domain=Domain(0, 1))
pdecon = Deconstruct(Point=md_slider)  # -> XComponent, YComponent, ZComponent
box_2 = EvaluateBox(Box=bbox.Box, UParameter=pdecon.XComponent, VParameter=pdecon.YComponent, WParameter=Slider(0.5, range=0..1))  # -> Plane, Point, Include

md_slider_2 = MDSlider(
    SliderMode=0,
    slider_value=Point(1, 0.4982223511, 0.5),
    x_domain=Domain(0, 1),
    y_domain=Domain(0, 1),
    z_domain=Domain(0, 1))
pdecon_2 = Deconstruct(Point=md_slider_2)  # -> XComponent, YComponent, ZComponent
box_3 = EvaluateBox(Box=bbox.Box, UParameter=pdecon_2.XComponent, VParameter=pdecon_2.YComponent, WParameter=Slider(0.5, range=0..1))  # -> Plane, Point, Include

clean = CombineClean(Meshes=triremesh.Triangulation)
weldvertices = MeshWeldVertices(Mesh=clean, Tolerance=0.01)  # -> RuntimeMessage, Mesh
cullvertices = MeshCullUnusedVertices(Mesh=weldvertices.Mesh)
alignvert = AlignVertices(Mesh=cullvertices, Tolerance=0.01)  # -> Result, Count
unim = UnifyMesh(Mesh=alignvert.Result)  # -> Result, Count

tri = Triangulate(Mesh=unim.Result)  # -> Mesh, Count
# Mesh Expot
panel_6 = Panel("")

# ---- group: COMP:
pcexportstl = ExportSTL(
    Mesh=tri.Mesh,
    Relocate=Toggle(False),
    SavePath=concat,
    SaveAsBinaryFile=Toggle(True),
    SaveNow=Toggle(True),
    LastSaveLocalization="neutral,N")

# ----
# Mesh Sanity Check
disjoint = DisjointMesh(Mesh=tri.Mesh)

unweld = UnweldMesh(Mesh=tri.Mesh, Angle=degrees(Slider(15, range=0..360)))
weld = WeldMesh(Mesh=unweld, Angle=degrees(Slider(45, range=0..360)))
shader = Shader({diffuse=RGB(250, 250, 250), emission=RGB(0, 0, 0), shine=0.85, specular=RGB(172, 172, 172), transparency=0})
preview = CustomPreview(Geometry=weld, Material=shader)  # disabled

exported_mesh = Geometry(tri.Mesh)

popgeo = PopulateGeometry(Geometry=tri.Mesh, Count=100, Seed=1)
meshcp = MeshClosestPoint(Point=popgeo, Mesh=tri.Mesh)  # -> Point, Index, Parameter
meval = MeshEval(Mesh=tri.Mesh, Parameter=meshcp.Parameter)  # -> Point, Normal, Colour
line = LineSDL(Start=meval.Point, Direction=meval.Normal, Length=Slider(0.1, range=0..0.1))
vdisex = VectorDisplayEx(Point=meval.Point, Vector=line, Colour=RGB(0, 0, 0), Width=1)

export_status = Panel(pcexportstl)
# Plot Boundary
panel_7 = Panel("")
# Matlab PDE 3D
panel_8 = Panel("")

# ---- group: VAR:
number_slider_16 = Slider(0.6, range=0..1)
number_slider_17 = Slider(0.5, range=0..1)
number_slider_18 = Slider(0, range=-1..1000)
number_slider_19 = Slider(30, range=0..200)
number_slider_20 = Slider(1000, range=-1..1000)
number_slider_21 = Slider(1, range=0..10)

# ----
bbox_2 = BoundingBox(Content=flatten(exported_mesh), Plane=PlaneXY(0, 0, 0), UnionBox=True)  # -> Box, Box_2
area = Area(Geometry=bbox_2.Box)  # -> Area, Centroid
scale_nu = ScaleNU(Geometry=bbox_2.Box, Plane=area.Centroid, ScaleX=Slider(1.2, range=0..10), ScaleY=1, ScaleZ=1)  # -> Geometry, Transform

debrep = DeconstructBrep(Brep=scale_nu.Geometry)  # -> Faces, Edges, Vertices
area_2 = Area(Geometry=debrep.Faces)  # -> Area, Centroid
pdecon_3 = Deconstruct(Point=area_2.Centroid)  # -> XComponent, YComponent, ZComponent
sort = SortList(Keys=pdecon_3.ZComponent, ValuesA=debrep.Faces)  # -> Keys, ValuesA
item = ListItem(List=sort.ValuesA, Index=0, Wrap=True)

debrep_2 = DeconstructBrep(Brep=item)  # -> Faces, Edges, Vertices
pcen = PolygonCenter(Polyline=debrep_2.Edges)  # -> CenterV, CenterE, CenterA
pdecon_4 = Deconstruct(Point=pcen.CenterE)  # -> XComponent, YComponent, ZComponent
sort_2 = SortList(Keys=pdecon_4.XComponent, ValuesA=debrep_2.Edges)  # -> Keys, ValuesA
item_2 = ListItem(List=reverse(sort_2.ValuesA), Index=0, Wrap=True)

end = EndPoints(Curve=item_2)  # -> Start, End
pdecon_5 = Deconstruct(Point=end.Start)  # -> XComponent, YComponent, ZComponent
pdecon_6 = Deconstruct(Point=end.End)  # -> XComponent, YComponent, ZComponent
larger = LargerThan(FirstNumber=pdecon_5.YComponent, SecondNumber=pdecon_6.YComponent)  # -> LargerThan, OrEqualTo
flip = FlipCurve(Curve=item_2)  # -> Curve, Flag
filter = StreamFilter(Gate=larger.LargerThan, Stream0=flip.Curve, Stream1=item_2)

# ---- group: VAR:
list = ValueList({"Steady State": True, "Transient": False}, selected="Transient")
path = FilePath(concat)
list_2 = ValueList({"Temp Temp": 0, "Temp Flux": 1, "Flux Temp": 2, "Flux Flux": 3}, selected="Flux Temp")

# ---- group: COMP:
run = FalseStartToggle(True)
filter_2 = StreamFilter(Gate=run, Stream1=list)

# ---- group: VAR:
subtraction_2 = Subtraction(A=number_slider_19, B=1)
multiplication_2 = Multiplication(A=subtraction_2, B=Slider(0.184, range=0.015..1))
time_frame = Data(multiplication_2)

# ---- group: COMP:
hops = Hops(
    Mode=filter_2,
    File=path,
    HMax=number_slider_15,
    ThermConductivity=number_slider_16,
    MassDenssity=number_slider_17,
    ThermalBoundaryCondition=list_2,
    Point1=box_2.Point,
    Point2=box_3.Point,
    Temp1=number_slider_20,
    Temp2=number_slider_18,
    Step=number_slider_21,
    Count=number_slider_19,
    CacheResultsInMemory=False,
    CacheSolveResults=False,
    RemoteDefinitionLocation="http://127.0.0.1:5000/PDE_3D",
    RemoteSolveVersion=(0, 1, 0),
    ShowInput_Enabled=False,
    ShowInput_Path=False,
    SynchronousSolve=True)  # -> Time, Vertex, Temp, AverageTemp, QX, QY, QZ

# ----
computation_time = Panel(hops.Time)
# Formatting Data
panel_10 = Panel("")

range = Range(Domain=Domain(0, 1), Steps=Slider(10, range=0..10))

len = Length(Curve=filter)
multiplication_3 = Multiplication(A=len, B=Slider(0.05, range=0..0.1))
pcen_2 = PolygonCenter(Polyline=filter)  # -> CenterV, CenterE, CenterA
dom_5 = ConstructDomain(DomainStart=expr("x/2", multiplication_3), DomainEnd=expr("-x/2", multiplication_3))
dom_6 = ConstructDomain(DomainStart=expr("x/2", len), DomainEnd=expr("-x/2", len))
rectangle_3 = Rectangle(Plane=pcen_2.CenterE, XSize=dom_5, YSize=dom_6, Radius=0)  # -> Rectangle, Length

graft = GraftTree(Tree=hops.Vertex, IncludeEmptyLists=True, IncludeNullItems=True)

split = TextSplit(Text=hops.QX, Separators=",")

split_2 = TextSplit(Text=hops.QY, Separators=",")

split_3 = TextSplit(Text=hops.QZ, Separators=",")

split_4 = TextSplit(Text=hops.Temp, Separators=",")

time_frame_2 = Data(time_frame)
item_3 = ListItem(List=split_4, Index=time_frame_2, Wrap=True)

time_frame_3 = Data(time_frame)
item_4 = ListItem(List=split, Index=time_frame_3, Wrap=True)

time_frame_4 = Data(time_frame)
item_5 = ListItem(List=split_2, Index=time_frame_4, Wrap=True)

time_frame_5 = Data(time_frame)
item_6 = ListItem(List=split_3, Index=time_frame_5, Wrap=True)

num = Number(item_3)
eval = Evaluate(F="round(x,y)", x=num, y=Slider(0, range=0..10))

eval_2 = EvaluateCurve(Curve=reparameterize(filter), Parameter=range)  # -> Point, Tangent, Angle

dom_7 = ConstructDomain(DomainStart=number_slider_20, DomainEnd=number_slider_18)
remap_2 = RemapNumbers(Value=eval, Source=dom_7, Target=Domain(0, 1))  # -> Mapped, Clipped

remap_3 = RemapNumbers(Value=range, Source=Domain(0, 1), Target=dom_7)  # -> Mapped, Clipped
int = Integer(remap_3.Mapped)

vec = VectorXYZ(XComponent=item_4, YComponent=item_5, ZComponent=item_6)  # -> Vector, Length

number_slider_22 = Slider(10, range=0..10)
mplane = MeshPlane(Boundary=rectangle_3.Rectangle, WidthCount=number_slider_22, HeightCount=number_slider_22)  # -> Mesh, Area

# ---- group: VAR:
dom_8 = ConstructDomain(DomainStart=Slider(0, range=0..1), DomainEnd=Slider(0.65, range=0..1))

# ----
remap_4 = RemapNumbers(Value=range, Source=Domain(0, 1), Target=dom_8)  # -> Mapped, Clipped
hsl = ColourHSL(Alpha=1, Hue=remap_4.Mapped, Saturation=1, Luminance=0.5)

# ---- group: VAR:
_10º = PowerOf10(Value=Slider(4, range=0..10))
one_over_x = OneOverX(Value=_10º)
multiplication_4 = Multiplication(A=vec.Vector, B=one_over_x, C=Slider(0.73, range=0..1))

# ----
remap_5 = RemapNumbers(Value=remap_2.Mapped, Source=Domain(0, 1), Target=dom_8)  # -> Mapped, Clipped
hsl_2 = ColourHSL(Alpha=1, Hue=remap_5.Mapped, Saturation=1, Luminance=0.5)

X = UnitX(Factor=multiplication_3)
move = Move(Geometry=eval_2.Point, Motion=X)  # -> Geometry, Transform

flatten = FlattenTree(Tree=graft, Path="{0}")
flatten_2 = FlattenTree(Tree=hsl_2, Path="{0}")

# ----
# Plot Legend
panel_11 = Panel("")
exported_mesh_2 = Geometry(tri.Mesh)

# ---- group: DISP:
tag = TextTag3D(
    Location=move.Geometry,
    Text=int,
    Size=Slider(0.026, range=0..0.1),
    Colour=ColourSwatch(SwatchColor=RGB(0, 0, 0)),
    Justification=4)

cloud = CloudDisplay(Points=flatten, Colours=flatten_2, Size=Slider(0.004, range=0..0.05), SpriteType=0)

vdisex_2 = VectorDisplayEx(Point=graft, Vector=multiplication_4, Colour=RGB(0, 0, 0), Width=Slider(1, range=0..1))

# ----
geometry = Geometry(extr)

# ---- group: SUB_DISP:
mspray = MeshSpray(Mesh=exported_mesh_2, Points=flatten, Colours=flatten_2, SprayMode=0)

# ----
mesh_colored = Geometry(mspray)

# ---- group: DISP:
mspray_2 = MeshSpray(Mesh=mplane.Mesh, Points=eval_2.Point, Colours=hsl, SprayMode=0)

# ----
bbox_3 = BoundingBox(Content=geometry, Plane=PlaneXY(0, 0, 0))  # -> Box, Box_2

# ---- group: VAR:
box_4 = EvaluateBox(Box=bbox_3.Box, UParameter=Slider(0.26, range=0..1), VParameter="0.5", WParameter="0.5")  # -> Plane, Point, Include
yz = YZPlane(Origin=box_4.Point)

box_5 = EvaluateBox(Box=bbox_3.Box, UParameter="0.5", VParameter="0.5", WParameter=Slider(0.6, range=0..1))  # -> Plane, Point, Include
xy = XYPlane(Origin=box_5.Point)

box_6 = EvaluateBox(Box=bbox_3.Box, UParameter="0.5", VParameter=Slider(0.88, range=0..1), WParameter="0.5")  # -> Plane, Point, Include
xz = XZPlane(Origin=box_6.Point)

# ----
project = Project(Geometry=flatten, Plane=xy)  # -> Geometry, Transform
dist = Distance(PointA=flatten, PointB=project.Geometry)
smaller = SmallerThan(FirstNumber=dist, SecondNumber=Slider(0.02, range=0..1))  # -> SmallerThan, OrEqualTo

project_2 = Project(Geometry=flatten, Plane=xz)  # -> Geometry, Transform
dist_2 = Distance(PointA=flatten, PointB=project_2.Geometry)
smaller_2 = SmallerThan(FirstNumber=dist_2, SecondNumber=Slider(0.02, range=0..1))  # -> SmallerThan, OrEqualTo

project_3 = Project(Geometry=flatten, Plane=yz)  # -> Geometry, Transform
dist_3 = Distance(PointA=flatten, PointB=project_3.Geometry)
smaller_3 = SmallerThan(FirstNumber=dist_3, SecondNumber=Slider(0.02, range=0..1))  # -> SmallerThan, OrEqualTo

# ---- group: COMP:
geometry_2 = Geometry(extr)
sec = BrepPlane(Brep=geometry_2, Plane=xy)  # -> Curves, Points
boundary_2 = BoundarySurfaces(Edges=sec.Curves)
mesh_2 = MeshBrep(
    Brep=boundary_2,
    Settings={GridMaxCount=0, GridMinCount=16, JaggedSeams=False, MaxEdgeLength=0, MinEdgeLength=0.0001, MinTolerance=0, Refine=True, RefineAngle=0, RelativeTolerance=0.65, SimplePlanes=True, Tolerance=0})
multiplication_5 = Multiplication(A=number_slider_15, B=Slider(0.5, range=0..1))
triremesh_2 = TriRemesh(Geometry=mesh_2, Sharp=Toggle(True), Length=multiplication_5, Iterations=Slider(20, range=0..100))  # -> Triangulation, Dual, Creases

geometry_3 = Geometry(extr)
sec_2 = BrepPlane(Brep=geometry_3, Plane=xz)  # -> Curves, Points
boundary_3 = BoundarySurfaces(Edges=sec_2.Curves)
mesh_3 = MeshBrep(
    Brep=boundary_3,
    Settings={GridMaxCount=0, GridMinCount=16, JaggedSeams=False, MaxEdgeLength=0, MinEdgeLength=0.0001, MinTolerance=0, Refine=True, RefineAngle=0, RelativeTolerance=0.65, SimplePlanes=True, Tolerance=0})
multiplication_6 = Multiplication(A=number_slider_15, B=Slider(0.5, range=0..1))
triremesh_3 = TriRemesh(Geometry=mesh_3, Sharp=Toggle(True), Length=multiplication_6, Iterations=Slider(20, range=0..100))  # -> Triangulation, Dual, Creases

geometry_4 = Geometry(extr)
sec_3 = BrepPlane(Brep=geometry_4, Plane=yz)  # -> Curves, Points
boundary_4 = BoundarySurfaces(Edges=sec_3.Curves)
mesh_4 = MeshBrep(
    Brep=boundary_4,
    Settings={GridMaxCount=0, GridMinCount=16, JaggedSeams=False, MaxEdgeLength=0, MinEdgeLength=0.0001, MinTolerance=0, Refine=True, RefineAngle=0, RelativeTolerance=0.65, SimplePlanes=True, Tolerance=0})
multiplication_7 = Multiplication(A=number_slider_15, B=Slider(0.5, range=0..1))
triremesh_4 = TriRemesh(Geometry=mesh_4, Sharp=Toggle(True), Length=multiplication_7, Iterations=Slider(20, range=0..100))  # -> Triangulation, Dual, Creases

# ----
dom_9 = ConstructDomain(DomainStart=Slider(0, range=0..1), DomainEnd=Slider(0.65, range=0..1))

dom_10 = ConstructDomain(DomainStart=Slider(0, range=0..1), DomainEnd=Slider(0.65, range=0..1))

dom_11 = ConstructDomain(DomainStart=Slider(0, range=0..1), DomainEnd=Slider(0.65, range=0..1))

dispatch = Dispatch(List=flatten(multiplication_4), DispatchPattern=smaller.SmallerThan)  # -> ListA, ListB
dispatch_2 = Dispatch(List=flatten_2, DispatchPattern=smaller.SmallerThan)  # -> ListA, ListB
dispatch_3 = Dispatch(List=project.Geometry, DispatchPattern=smaller.SmallerThan)  # -> ListA, ListB

dispatch_4 = Dispatch(List=flatten(multiplication_4), DispatchPattern=smaller_2.SmallerThan)  # -> ListA, ListB
dispatch_5 = Dispatch(List=flatten_2, DispatchPattern=smaller_2.SmallerThan)  # -> ListA, ListB
dispatch_6 = Dispatch(List=project_2.Geometry, DispatchPattern=smaller_2.SmallerThan)  # -> ListA, ListB

dispatch_7 = Dispatch(List=flatten(multiplication_4), DispatchPattern=smaller_3.SmallerThan)  # -> ListA, ListB
dispatch_8 = Dispatch(List=flatten_2, DispatchPattern=smaller_3.SmallerThan)  # -> ListA, ListB
dispatch_9 = Dispatch(List=project_3.Geometry, DispatchPattern=smaller_3.SmallerThan)  # -> ListA, ListB

ahsl = SplitAHSL(Colour=dispatch_2.ListA)  # -> Alpha, Hue, Saturation, Luminance
remap_6 = RemapNumbers(Value=ahsl.Hue, Source=dom_9, Target=Domain(0, 1))  # -> Mapped, Clipped
Z_2 = UnitZ(Factor=remap_6.Mapped)

ahsl_2 = SplitAHSL(Colour=dispatch_5.ListA)  # -> Alpha, Hue, Saturation, Luminance
remap_7 = RemapNumbers(Value=ahsl_2.Hue, Source=dom_10, Target=Domain(0, 1))  # -> Mapped, Clipped
Y = UnitY(Factor=remap_7.Mapped)

ahsl_3 = SplitAHSL(Colour=dispatch_8.ListA)  # -> Alpha, Hue, Saturation, Luminance
remap_8 = RemapNumbers(Value=ahsl_3.Hue, Source=dom_11, Target=Domain(0, 1))  # -> Mapped, Clipped
X_2 = UnitX(Factor=remap_8.Mapped)

move_2 = Move(Geometry=dispatch_9.ListA, Motion=X_2)  # -> Geometry, Transform
del = DelaunayMesh(Points=move_2.Geometry, Plane=yz)

move_3 = Move(Geometry=dispatch_3.ListA, Motion=Z_2)  # -> Geometry, Transform
del_2 = DelaunayMesh(Points=move_3.Geometry, Plane=xy)

move_4 = Move(Geometry=dispatch_6.ListA, Motion=Y)  # -> Geometry, Transform
del_3 = DelaunayMesh(Points=move_4.Geometry, Plane=xz)

Z_3 = UnitZ(Factor=1)
contour = Contour(Shape=del_2, Point=Point(0, 0, 0), Direction=Z_3, Distance=Slider(0.03, range=0..1))
project_4 = Project(Geometry=contour, Plane=xy)  # -> Geometry, Transform

Y_2 = UnitY(Factor=1)
contour_2 = Contour(Shape=del_3, Point=Point(0, 0, 0), Direction=Y_2, Distance=Slider(0.03, range=0..1))
project_5 = Project(Geometry=contour_2, Plane=xz)  # -> Geometry, Transform

X_3 = UnitX(Factor=1)
contour_3 = Contour(Shape=del, Point=Point(0, 0, 0), Direction=X_3, Distance=Slider(0.03, range=0..1))
project_6 = Project(Geometry=contour_3, Plane=yz)  # -> Geometry, Transform

len_2 = Length(Curve=project_4.Geometry)
division_5 = Division(A=len_2, B=Slider(0.05, range=0..1))
divide = DivideCurve(Curve=project_4.Geometry, Count=division_5, Kinks=False)  # -> Points, Tangents, Parameters
cls = Closed(Curve=project_4.Geometry)  # -> Closed, Periodic
intcrv = Interpolate(Vertices=divide.Points, Degree=3, Periodic=cls.Periodic, KnotStyle=1)  # -> Curve, Length, Domain

len_3 = Length(Curve=project_5.Geometry)
division_6 = Division(A=len_3, B=Slider(0.02, range=0..1))
divide_2 = DivideCurve(Curve=project_5.Geometry, Count=division_6, Kinks=False)  # -> Points, Tangents, Parameters
cls_2 = Closed(Curve=project_5.Geometry)  # -> Closed, Periodic
intcrv_2 = Interpolate(Vertices=divide_2.Points, Degree=3, Periodic=cls_2.Periodic, KnotStyle=1)  # -> Curve, Length, Domain

len_4 = Length(Curve=project_6.Geometry)
division_7 = Division(A=len_4, B=Slider(0.01, range=0..1))
divide_3 = DivideCurve(Curve=project_6.Geometry, Count=division_7, Kinks=False)  # -> Points, Tangents, Parameters
cls_3 = Closed(Curve=project_6.Geometry)  # -> Closed, Periodic
intcrv_3 = Interpolate(Vertices=divide_3.Points, Degree=3, Periodic=cls_3.Periodic, KnotStyle=1)  # -> Curve, Length, Domain

# ---- group: SUB_DISP:
mspray_3 = MeshSpray(Mesh=triremesh_2.Triangulation, Points=dispatch_3.ListA, Colours=dispatch_2.ListA, SprayMode=0)

mspray_4 = MeshSpray(Mesh=triremesh_3.Triangulation, Points=dispatch_6.ListA, Colours=dispatch_5.ListA, SprayMode=0)

mspray_5 = MeshSpray(Mesh=triremesh_4.Triangulation, Points=dispatch_9.ListA, Colours=dispatch_8.ListA, SprayMode=0)

vdisex_3 = VectorDisplayEx(Point=dispatch_3.ListA, Vector=dispatch.ListA, Colour=RGB(0, 0, 0), Width=Slider(1, range=0..1))

vdisex_4 = VectorDisplayEx(Point=dispatch_6.ListA, Vector=dispatch_4.ListA, Colour=RGB(0, 0, 0), Width=Slider(1, range=0..1))

vdisex_5 = VectorDisplayEx(Point=dispatch_9.ListA, Vector=dispatch_7.ListA, Colour=RGB(0, 0, 0), Width=Slider(1, range=0..1))

previewlw = CustomPreviewLineweights(Geometry=sec.Curves, Shader=ColourSwatch(SwatchColor=RGB(0, 0, 0)), Thickness=Slider(2, range=0..10), Absolute=False)

previewlw_2 = CustomPreviewLineweights(
    Geometry=intcrv.Curve,
    Shader=ColourSwatch(SwatchColor=RGB(255, 255, 255)),
    Thickness=Slider(2, range=0..10),
    Absolute=False)

previewlw_3 = CustomPreviewLineweights(Geometry=sec_2.Curves, Shader=ColourSwatch(SwatchColor=RGB(0, 0, 0)), Thickness=Slider(2, range=0..10), Absolute=False)

previewlw_4 = CustomPreviewLineweights(
    Geometry=intcrv_2.Curve,
    Shader=ColourSwatch(SwatchColor=RGB(255, 255, 255)),
    Thickness=Slider(2, range=0..10),
    Absolute=False)

previewlw_5 = CustomPreviewLineweights(Geometry=sec_3.Curves, Shader=ColourSwatch(SwatchColor=RGB(0, 0, 0)), Thickness=Slider(2, range=0..10), Absolute=False)

previewlw_6 = CustomPreviewLineweights(
    Geometry=intcrv_3.Curve,
    Shader=ColourSwatch(SwatchColor=RGB(255, 255, 255)),
    Thickness=Slider(2, range=0..10),
    Absolute=False)

# ----
# Plot Temp Analytics
panel_15 = Panel("")

T = Data(split_4)
vertex = Point(hops.Vertex)
survey_region = Geometry(<brep referenced from the Rhino model>)
flip_2 = FlipMatrix(Data=T)
brepinc = PointInBrep(Brep=survey_region, Point=vertex, Strict=False)
dispatch_10 = Dispatch(List=flip_2, DispatchPattern=brepinc)  # -> ListA, ListB
dispatch_11 = Dispatch(List=vertex, DispatchPattern=brepinc)  # -> ListA, ListB
num_2 = Number(dispatch_10.ListA)
geo_2 = Geometry(dispatch_11.ListA)
avr = Average(Input=num_2)  # -> flatten(ArithmeticMean)

t1 = Data(number_slider_20)
t2 = Data(number_slider_18)
avr_2 = Data(hops.AverageTemp)
entwine = Entwine(Branch00=t1, Branch01=t2, Branch02=avr_2, Branch03=t1, Branch04=t2, FlattenInputs=True)  # -> flatten(Result)

lng = ListLength(List=avr_2)
subtraction_3 = Subtraction(A=lng, B=1)
series = Series(Start=0, Step=1, Count=subtraction_3)
item_7 = ListItem(List=avr_2, Index=series, Wrap=True)  # -> Item, Item1
subtraction_4 = Subtraction(A=item_7.Item1, B=item_7.Item)

lng_2 = ListLength(List=avr)
subtraction_5 = Subtraction(A=lng_2, B=1)
series_2 = Series(Start=0, Step=1, Count=subtraction_5)
item_8 = ListItem(List=avr, Index=series_2, Wrap=True)  # -> Item, Item1
subtraction_6 = Subtraction(A=item_8.Item1, B=item_8.Item)

# ---- group: DISP:Average Temp per Phase
graph = QuickGraph(subtraction_4, SortOrder=0)

# ---- group: DISP:End Temp
graph_2 = QuickGraph(avr, SortOrder=0)

graph_3 = QuickGraph(subtraction_6, SortOrder=0)

# ---- group: DISP:Average Temp per Phase
graph_4 = QuickGraph(entwine, SortOrder=0)

# ----
# Plot Graph
panel_16 = Panel("")

geo_3 = Geometry([<curve referenced from the Rhino model> x4])
explode = Explode(Curve=geo_3, Recursive=True)  # -> Segments, Vertices
pcen_3 = PolygonCenter(Polyline=explode.Segments)  # -> CenterV, CenterE, CenterA
pdecon_7 = Deconstruct(Point=pcen_3.CenterE)  # -> XComponent, YComponent, ZComponent
pdecon_8 = Deconstruct(Point=pcen_3.CenterE)  # -> XComponent, YComponent, ZComponent
sort_3 = SortList(Keys=pdecon_7.YComponent, ValuesA=explode.Segments)  # -> Keys, ValuesA
sort_4 = SortList(Keys=pdecon_8.XComponent, ValuesA=explode.Segments)  # -> Keys, ValuesA
item_9 = ListItem(List=sort_3.ValuesA, Index=0, Wrap=True)
item_10 = ListItem(List=sort_4.ValuesA, Index=0, Wrap=True)
swatch = ColourSwatch(SwatchColor=RGB(0, 0, 0))

# ---- group: VAR:
number_slider_23 = Slider(48, range=0..100)

var = Slider(0.5, range=0..1)
number_slider_24 = Slider(0.7, range=0..1)

number_slider_25 = Slider(300, range=0..1000)

# ----
dom_12 = ConstructDomain(DomainStart=0, DomainEnd=number_slider_25)
remap_9 = RemapNumbers(Value=subtraction_4, Source=dom_12, Target=Domain(0, 1))  # -> Mapped, Clipped

range_2 = Range(Domain=Domain(0, 1), Steps=expr("x-1", number_slider_19))
pt = ConstructPoint(XCoordinate=range_2, YCoordinate=remap_9.Mapped, ZCoordinate=0)
geo_4 = Geometry(<curve referenced from the Rhino model>)
evalsrf = EvaluateSurface(Surface=reparameterize(geo_4), Point=pt)  # -> Point, Normal, UDirection, VDirection, Frame

dom_13 = ConstructDomain(DomainStart=0, DomainEnd=number_slider_23)
remap_10 = RemapNumbers(Value=subtraction_6, Source=dom_13, Target=Domain(0, 1))  # -> Mapped, Clipped

range_3 = Range(Domain=Domain(0, 1), Steps=expr("x-1", number_slider_19))
pt_2 = ConstructPoint(XCoordinate=range_3, YCoordinate=remap_10.Mapped, ZCoordinate=0)
geo_5 = Geometry(<curve referenced from the Rhino model>)
evalsrf_2 = EvaluateSurface(Surface=reparameterize(geo_5), Point=pt_2)  # -> Point, Normal, UDirection, VDirection, Frame

dom_14 = ConstructDomain(DomainStart=var, DomainEnd=number_slider_24)
animate_2 = Data(animate)
remap_11 = RemapNumbers(Value=animate_2, Source=dom_14, Target=Domain(0, 1))  # -> Mapped, Clipped
hsl_3 = ColourHSL(Alpha=1, Hue=remap_11.Mapped, Saturation=1, Luminance=0.5)
color = Data(hsl_3)

avr_3 = Data(hops.AverageTemp)
t2_2 = Data(number_slider_18)
t1_2 = Data(number_slider_20)
dom_15 = ConstructDomain(DomainStart=t2_2, DomainEnd=t1_2)
remap_12 = RemapNumbers(Value=avr_3, Source=dom_15, Target=Domain(0, 1))  # -> Mapped, Clipped

range_4 = Range(Domain=Domain(0, 1), Steps=expr("x-1", number_slider_19))
pt_3 = ConstructPoint(XCoordinate=range_4, YCoordinate=remap_12.Mapped, ZCoordinate=0)
geo_6 = Geometry(<curve referenced from the Rhino model>)
evalsrf_3 = EvaluateSurface(Surface=reparameterize(geo_6), Point=pt_3)  # -> Point, Normal, UDirection, VDirection, Frame

t2_3 = Data(number_slider_18)
t1_3 = Data(number_slider_20)
dom_16 = ConstructDomain(DomainStart=t2_3, DomainEnd=t1_3)
remap_13 = RemapNumbers(Value=avr, Source=dom_16, Target=Domain(0, 1))  # -> Mapped, Clipped

range_5 = Range(Domain=Domain(0, 1), Steps=expr("x-1", number_slider_19))
pt_4 = ConstructPoint(XCoordinate=range_5, YCoordinate=remap_13.Mapped, ZCoordinate=0)
geo_7 = Geometry(<curve referenced from the Rhino model>)
evalsrf_4 = EvaluateSurface(Surface=reparameterize(geo_7), Point=pt_4)  # -> Point, Normal, UDirection, VDirection, Frame

pline = PolyLine(Vertices=evalsrf_2.Point, Closed=False)
pline_2 = PolyLine(Vertices=evalsrf_3.Point, Closed=False)
pline_3 = PolyLine(Vertices=evalsrf.Point, Closed=False)
pline_4 = PolyLine(Vertices=evalsrf_4.Point, Closed=False)

# ---- group: DISP:
number_slider_26 = Slider(3, range=0..10)

# ---- group: DISP_POST:
previewlw_7 = CustomPreviewLineweights(Geometry=item_9, Shader=swatch, Absolute=False)
previewlw_8 = CustomPreviewLineweights(Geometry=item_10, Shader=swatch, Absolute=False)

previewlw_9 = CustomPreviewLineweights(Geometry=pline_2, Shader=color, Thickness=number_slider_26, Absolute=False)
previewlw_10 = CustomPreviewLineweights(Geometry=pline_3, Shader=color, Thickness=number_slider_26, Absolute=False)
previewlw_11 = CustomPreviewLineweights(Geometry=pline_4, Shader=color, Thickness=number_slider_26, Absolute=False)
previewlw_12 = CustomPreviewLineweights(Geometry=pline, Shader=color, Thickness=number_slider_26, Absolute=False)

# ----
# Bake Graph
panel_19 = Panel("")
# Bake Mesh
panel_20 = Panel("")

# ---- group: VAR:
falsestart = LBFalseStartToggle(False)  # disabled
bake_2 = Data(falsestart)  # disabled

panel_21 = Panel("Matlab PDE 3D Mesh")  # disabled
layers = CreateModifyLayers(LayerName=panel_21, DeleteLayer=False, enableFullPath=False)  # -> LayerNames, LayerFullPath; disabled
pde_2d_mesh_layer = Data(layers.LayerNames)  # disabled

panel_22 = Panel("Matlab PDE 3D Graph")  # disabled
layers_2 = CreateModifyLayers(LayerName=panel_22, DeleteLayer=False, enableFullPath=False)  # -> LayerNames, LayerFullPath; disabled
pde_2d_graph_layer = Data(layers_2.LayerNames)  # disabled

# ---- group: OUT:
W = Data()  # disabled
H = Data()  # disabled
mesh_colored_2 = Geometry(mesh_colored)  # disabled
pde_2d_mesh_layer_2 = Data(pde_2d_mesh_layer)  # disabled
name = Data()  # disabled
panel_23 = Panel("""W
H
O""")  # disabled
panel_24 = Panel("PDE 2D Mesh")  # disabled
entwine_2 = Entwine(Branch00=W, Branch01=H, Branch02=panel_24, FlattenInputs=True)  # -> flatten(Result); disabled
bake_3 = Data(bake_2)  # disabled
createatts = CreateAttributes(Name=name, LayerName=pde_2d_mesh_layer_2, UserDataKeys=panel_23, UserDataValues=entwine_2, enableFullPath=False)  # disabled
bake_4 = BakeGeometry(Bake=bake_3, Geometry=mesh_colored_2, Attributes=createatts, DeleteOldBakes=False, PreserveTrees=False)  # disabled

bake_5 = Data(bake_2)  # disabled
W_2 = Data()  # disabled
H_2 = Data()  # disabled
name_2 = Data()  # disabled
pde_2d_graph_layer_2 = Data(pde_2d_graph_layer)  # disabled
color_2 = Data()  # disabled
panel_25 = Panel("PDE 2D AVR Temp")  # disabled
entwine_3 = Entwine(Branch00=W_2, Branch01=H_2, Branch02=panel_25, FlattenInputs=True)  # -> flatten(Result); disabled
createatts_2 = CreateAttributes(
    Name=name_2,
    LayerName=pde_2d_graph_layer_2,
    Color=color_2,
    UserDataKeys=panel_23,
    UserDataValues=entwine_3,
    enableFullPath=False)  # disabled
bake_6 = BakeGeometry(Bake=bake_5, Attributes=createatts_2, DeleteOldBakes=False, PreserveTrees=False)  # disabled

W_3 = Data()  # disabled
H_3 = Data()  # disabled
bake_7 = Data(bake_2)  # disabled
pde_2d_graph_layer_3 = Data(pde_2d_graph_layer)  # disabled
name_3 = Data()  # disabled
color_3 = Data()  # disabled
panel_26 = Panel("PDE 2D E2 Temp")  # disabled
entwine_4 = Entwine(Branch00=W_3, Branch01=H_3, Branch02=panel_26, FlattenInputs=True)  # -> flatten(Result); disabled
createatts_3 = CreateAttributes(
    Name=name_3,
    LayerName=pde_2d_graph_layer_3,
    Color=color_3,
    UserDataKeys=panel_23,
    UserDataValues=entwine_4,
    enableFullPath=False)  # disabled
bake_8 = BakeGeometry(Bake=bake_7, Attributes=createatts_3, DeleteOldBakes=False, PreserveTrees=False)  # disabled

W_4 = Data()  # disabled
H_4 = Data()  # disabled
color_4 = Data()  # disabled
name_4 = Data()  # disabled
pde_2d_graph_layer_4 = Data(pde_2d_graph_layer)  # disabled
panel_27 = Panel("PDE 2D AVR Temp Dif")  # disabled
entwine_5 = Entwine(Branch00=W_4, Branch01=H_4, Branch02=panel_27, FlattenInputs=True)  # -> flatten(Result); disabled
bake_9 = Data(bake_2)  # disabled
createatts_4 = CreateAttributes(
    Name=name_4,
    LayerName=pde_2d_graph_layer_4,
    Color=color_4,
    UserDataKeys=panel_23,
    UserDataValues=entwine_5,
    enableFullPath=False)  # disabled
bake_10 = BakeGeometry(Bake=bake_9, Attributes=createatts_4, DeleteOldBakes=False, PreserveTrees=False)  # disabled

W_5 = Data()  # disabled
H_5 = Data()  # disabled
pde_2d_graph_layer_5 = Data(pde_2d_graph_layer)  # disabled
color_5 = Data()  # disabled
name_5 = Data()  # disabled
panel_28 = Panel("PDE 2D E2 Temp Dif")  # disabled
entwine_6 = Entwine(Branch00=W_5, Branch01=H_5, Branch02=panel_28, FlattenInputs=True)  # -> flatten(Result); disabled
bake_11 = Data(bake_2)  # disabled
createatts_5 = CreateAttributes(
    Name=name_5,
    LayerName=pde_2d_graph_layer_5,
    Color=color_5,
    UserDataKeys=panel_23,
    UserDataValues=entwine_6,
    enableFullPath=False)  # disabled
bake_12 = BakeGeometry(Bake=bake_11, Attributes=createatts_5, DeleteOldBakes=False, PreserveTrees=False)  # disabled

# ----
# Reference Data
panel_30 = Panel("")

# ---- group: VAR:
toggle = FalseStartToggle(False)

# ----
# Sort Data
panel_32 = Panel("")
# Plot Graph
panel_34 = Panel("")

number_slider_27 = Slider(0.1, range=0..1)  # disabled
number_slider_28 = Slider(1, range=0..1)  # disabled
subtraction_7 = Subtraction(A=number_slider_28, B=number_slider_27)  # disabled

scale_factor = Slider(0.012, range=0..0.1)  # disabled
number_slider_29 = Slider(0.008, range=0..0.1)  # disabled
dom_17 = ConstructDomain(DomainStart=number_slider_27, DomainEnd=subtraction_7)  # disabled

number_slider_30 = Slider(2, range=0..10)  # disabled
swatch_2 = ColourSwatch(SwatchColor=RGB(0, 0, 0))  # disabled

# ----
# Plot Graph
panel_36 = Panel("")
# Plot Graph
panel_38 = Panel("")

groups = GetGroups()  # -> Groups, GroupStyles, Nickname, Color

len_5 = TextLength(Text=groups.Nickname)
txt = Text(len_5)
mindex = MemberIndex(Set=txt, Member="0")  # -> Index, Count
replace = ReplaceItems(List=groups.Nickname, Item="<empty>", Indices=mindex.Index, Wrap=False)

python = GhPythonScript(group_names=replace, search_name="DISP:")  # -> found_name; inputs group_names: list
# ---------- python: Python ----------
found_name=[]
for name in group_names:
    found = name.find(search_name)
    if found==0:
        found = 1
    else:
        found = 0
    found_name.append(found)
# ---------- end python ----------

panel_40 = Panel("""<empty>
VAR:
DISP:
SUB_DISP:
DISP_POST:
OUT:
COMP:""")
python_2 = GhPythonScript(group_names=replace, search_name=panel_40)  # -> found_name; inputs group_names: list; same code as python

flip_3 = FlipMatrix(Data=python_2)
ma = MassAddition(Input=flip_3)  # -> flatten(Result), PartialResults

dispatch_12 = Dispatch(List=groups.Groups, DispatchPattern=python)  # -> ListA, ListB
dispatch_13 = Dispatch(List=groups.Groups, DispatchPattern=python_2)  # -> ListA, ListB
dispatch_14 = Dispatch(List=groups.Groups, DispatchPattern=ma.Result)  # -> ListA, ListB
objfromgroup = GetObjectsInGroup(Group=dispatch_12.ListA)
hideshow = HideShowObjectPreview(Objects=objfromgroup, Visible=Toggle(True))
setgroup = SetGroupProperties(Group=dispatch_13.ListA, Color=merge)
# Matlab to Grasshopper
setgroup_2 = SetGroupProperties(Group=dispatch_14.ListB, Color=ColourSwatch(SwatchColor=RGB(255, 132, 0)))

# ---- group: COMP:
pde_2d_graph_layer_6 = Data()  # disabled
pde_2d_mesh_layer_3 = Data()  # disabled

panel_41 = Panel("mesh")  # disabled
dpipeline = DynamicGeometryPipeline(
    LayerFilter=pde_2d_mesh_layer_3,
    TypeFilter=panel_41,
    NameFilter="*",
    GroupByLayer=False,
    GroupByType=False,
    IncludeHidden=True,
    IncludeLocked=True,
    enableFullPath=False,
    listenToAttributes=True)  # disabled

panel_42 = Panel("curve")  # disabled
dpipeline_2 = DynamicGeometryPipeline(
    LayerFilter=pde_2d_graph_layer_6,
    TypeFilter=panel_42,
    NameFilter="*",
    GroupByLayer=False,
    GroupByType=False,
    IncludeHidden=True,
    IncludeLocked=True,
    enableFullPath=False,
    listenToAttributes=True)  # disabled

filter_3 = StreamFilter(Gate=toggle, Stream1=dpipeline)
filter_4 = StreamFilter(Gate=toggle, Stream1=dpipeline_2)
objatts = ObjectAttributes(ObjectOrAttributes=filter_3)  # -> Name, LayerName, LayerFullPath, Color, MaterialName, LinetypeName, GroupIndices, PlotWeight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; disabled
objatts_2 = ObjectAttributes(ObjectOrAttributes=filter_4)  # -> Name, LayerName, LayerFullPath, Color, MaterialName, LinetypeName, GroupIndices, PlotWeight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; disabled
tsort = SortText(Keys=objatts.Name, Values=filter_3, Culture=127)  # -> Keys, Values; disabled
tsort_2 = SortText(Keys=objatts_2.Name, Values=filter_4, Culture=127)  # -> Keys, Values; disabled

# ----
graft_2 = GraftTree(Tree=tsort_2.Values, IncludeEmptyLists=True, IncludeNullItems=True)  # disabled
objatts_3 = ObjectAttributes(ObjectOrAttributes=graft_2)  # -> Name, LayerName, LayerFullPath, Color, MaterialName, LinetypeName, GroupIndices, PlotWeight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; disabled

panel_43 = Panel("O")  # disabled
mindex_2 = MemberIndex(Set=objatts_3.UserDataKeys, Member=panel_43)  # -> Index, Count; disabled

item_11 = ListItem(List=objatts_3.UserDataValues, Index=mindex_2.Index, Wrap=True)  # disabled
cset = CreateSet(List=flatten(item_11))  # -> Set, Map; disabled
list_3 = ItemSelector(cset.Set, {"PDE 2D AVR Temp", "PDE 2D E2 Temp Dif", "PDE 2D AVR Temp Dif", "PDE 2D E2 Temp"}, selected="PDE 2D AVR Temp")  # disabled
mindex_3 = MemberIndex(Set=item_11, Member=list_3)  # -> Index, Count; disabled

item_12 = ListItem(List=graft_2, Index=mindex_3.Index, Wrap=True)  # -> flatten(Item); disabled

end_2 = EndPoints(Curve=item_12)  # -> Start, End; disabled
pdecon_9 = Deconstruct(Point=end_2.End)  # -> XComponent, YComponent, ZComponent; disabled

area_3 = Area(Geometry=tsort.Values)  # -> Area, Centroid; disabled
sort_5 = SortList(Keys=area_3.Area, ValuesTemp=pdecon_9.YComponent, ValuesArea=area_3.Area, ValuesMesh=tsort.Values)  # -> Keys, ValuesTemp, ValuesArea, ValuesMesh; disabled
sort_6 = SortList(Keys=pdecon_9.YComponent, ValuesTemp=pdecon_9.YComponent, ValuesArea=area_3.Area, ValuesMesh=tsort.Values)  # -> Keys, ValuesTemp, ValuesArea, ValuesMesh; disabled

bnd = Bounds(Numbers=flatten(sort_5.ValuesArea))  # disabled
remap_14 = RemapNumbers(Value=sort_5.ValuesArea, Source=bnd, Target=Domain(0, 1))  # -> Mapped, Clipped; disabled

bnd_2 = Bounds(Numbers=flatten(sort_5.ValuesTemp))  # disabled
remap_15 = RemapNumbers(Value=sort_5.ValuesTemp, Source=bnd_2, Target=dom_17)  # -> Mapped, Clipped; disabled

bnd_3 = Bounds(Numbers=flatten(sort_6.ValuesTemp))  # disabled
remap_16 = RemapNumbers(Value=sort_6.ValuesTemp, Source=bnd_3, Target=Domain(0, 1))  # -> Mapped, Clipped; disabled

bnd_4 = Bounds(Numbers=flatten(sort_6.ValuesArea))  # disabled
remap_17 = RemapNumbers(Value=sort_6.ValuesArea, Source=bnd_4, Target=dom_17)  # -> Mapped, Clipped; disabled

pt_5 = ConstructPoint(XCoordinate=remap_14.Mapped, YCoordinate=remap_15.Mapped, ZCoordinate=0)  # disabled
geo_8 = Geometry(<curve referenced from the Rhino model>)  # disabled
evalsrf_5 = EvaluateSurface(Surface=reparameterize(geo_8), Point=pt_5)  # -> Point, Normal, UDirection, VDirection, Frame; disabled

pt_6 = ConstructPoint(XCoordinate=remap_16.Mapped, YCoordinate=remap_17.Mapped, ZCoordinate=0)  # disabled
geo_9 = Geometry(<curve referenced from the Rhino model>)  # disabled
evalsrf_6 = EvaluateSurface(Surface=reparameterize(geo_9), Point=pt_6)  # -> Point, Normal, UDirection, VDirection, Frame; disabled

scale = Scale(Geometry=sort_5.ValuesMesh, Center=Point(0, 0, 0), Factor=scale_factor)  # -> Geometry, Transform; disabled
Y_3 = UnitY(Factor=number_slider_29)  # disabled
move_5 = Move(Geometry=evalsrf_5.Point, Motion=Y_3)  # -> Geometry, Transform; disabled
orient = Orient(Geometry=scale.Geometry, Source=PlaneXY(0, 0, 0), Target=move_5.Geometry)  # -> Geometry, Transform; disabled

scale_2 = Scale(Geometry=sort_6.ValuesMesh, Center=Point(0, 0, 0), Factor=scale_factor)  # -> Geometry, Transform; disabled
Y_4 = UnitY(Factor=number_slider_29)  # disabled
move_6 = Move(Geometry=evalsrf_6.Point, Motion=Y_4)  # -> Geometry, Transform; disabled
orient_2 = Orient(Geometry=scale_2.Geometry, Source=PlaneXY(0, 0, 0), Target=move_6.Geometry)  # -> Geometry, Transform; disabled

pline_5 = PolyLine(Vertices=evalsrf_5.Point, Closed=False)  # disabled
pline_6 = PolyLine(Vertices=evalsrf_6.Point, Closed=False)  # disabled

# ---- group: DISP_POST:
previewlw_13 = CustomPreviewLineweights(Geometry=pline_5, Shader=swatch_2, Thickness=number_slider_30, Absolute=False)  # disabled
previewlw_14 = CustomPreviewLineweights(Geometry=pline_6, Shader=swatch_2, Thickness=number_slider_30, Absolute=False)  # disabled

# ----
graft_3 = GraftTree(Tree=orient_2.Geometry, IncludeEmptyLists=True, IncludeNullItems=True)  # disabled
number_slider_31 = Slider(10, range=0..10)  # disabled
number_slider_32 = Slider(100, range=0..100)  # disabled
lng_3 = ListLength(List=flatten(graft_3))  # disabled
series_3 = Series(Start=number_slider_31, Step=number_slider_31, Count=lng_3)  # -> graft(Series); disabled
Z_4 = UnitZ(Factor=series_3)  # disabled
Z_5 = UnitZ(Factor=number_slider_32)  # disabled
move_7 = Move(Geometry=graft_3, Motion=Z_4)  # -> Geometry, Transform; disabled
medges = MeshEdges(Mesh=move_7.Geometry)  # -> NakedEdges, InteriorEdges, NonManifoldEdges; disabled
merge_3 = Merge(Data1=medges.NakedEdges, Data2=medges.NonManifoldEdges)  # disabled

graft_4 = GraftTree(Tree=orient.Geometry, IncludeEmptyLists=True, IncludeNullItems=True)  # disabled
number_slider_33 = Slider(10, range=0..10)  # disabled
number_slider_34 = Slider(100, range=0..100)  # disabled
lng_4 = ListLength(List=flatten(graft_4))  # disabled
series_4 = Series(Start=number_slider_33, Step=number_slider_33, Count=lng_4)  # -> graft(Series); disabled
Z_6 = UnitZ(Factor=series_4)  # disabled
Z_7 = UnitZ(Factor=number_slider_34)  # disabled
move_8 = Move(Geometry=graft_4, Motion=Z_6)  # -> Geometry, Transform; disabled
medges_2 = MeshEdges(Mesh=move_8.Geometry)  # -> NakedEdges, InteriorEdges, NonManifoldEdges; disabled
merge_4 = Merge(Data1=medges_2.NakedEdges, Data2=medges_2.NonManifoldEdges)  # disabled

# ---- group: DISP_POST:
swatch_3 = ColourSwatch(SwatchColor=RGB(0, 0, 0))  # disabled
previewlw_15 = CustomPreviewLineweights(Geometry=merge_3, Shader=swatch_3, Absolute=False)  # disabled
geo_10 = Geometry(move_7.Geometry)  # disabled

swatch_4 = ColourSwatch(SwatchColor=RGB(0, 0, 0))  # disabled
previewlw_16 = CustomPreviewLineweights(Geometry=merge_4, Shader=swatch_4, Absolute=False)  # disabled
geo_11 = Geometry(move_8.Geometry)  # disabled

# ----
explode_2 = Explode(Curve=geo_9, Recursive=True)  # -> Segments, Vertices; disabled
pcen_4 = PolygonCenter(Polyline=explode_2.Segments)  # -> CenterV, CenterE, CenterA; disabled
pdecon_10 = Deconstruct(Point=pcen_4.CenterE)  # -> XComponent, YComponent, ZComponent; disabled
pdecon_11 = Deconstruct(Point=pcen_4.CenterE)  # -> XComponent, YComponent, ZComponent; disabled
sort_7 = SortList(Keys=pdecon_10.YComponent, ValuesA=explode_2.Segments)  # -> Keys, ValuesA; disabled
sort_8 = SortList(Keys=pdecon_11.XComponent, ValuesA=explode_2.Segments)  # -> Keys, ValuesA; disabled
item_13 = ListItem(List=sort_7.ValuesA, Index=0, Wrap=True)  # disabled
item_14 = ListItem(List=sort_8.ValuesA, Index=0, Wrap=True)  # disabled

explode_3 = Explode(Curve=geo_8, Recursive=True)  # -> Segments, Vertices; disabled
pcen_5 = PolygonCenter(Polyline=explode_3.Segments)  # -> CenterV, CenterE, CenterA; disabled
pdecon_12 = Deconstruct(Point=pcen_5.CenterE)  # -> XComponent, YComponent, ZComponent; disabled
pdecon_13 = Deconstruct(Point=pcen_5.CenterE)  # -> XComponent, YComponent, ZComponent; disabled
sort_9 = SortList(Keys=pdecon_12.YComponent, ValuesA=explode_3.Segments)  # -> Keys, ValuesA; disabled
sort_10 = SortList(Keys=pdecon_13.XComponent, ValuesA=explode_3.Segments)  # -> Keys, ValuesA; disabled
item_15 = ListItem(List=sort_9.ValuesA, Index=0, Wrap=True)  # disabled
item_16 = ListItem(List=sort_10.ValuesA, Index=0, Wrap=True)  # disabled

# ---- group: DISP_POST:
swatch_5 = ColourSwatch(SwatchColor=RGB(0, 0, 0))  # disabled
previewlw_17 = CustomPreviewLineweights(Geometry=item_13, Shader=swatch_5, Absolute=False)  # disabled
previewlw_18 = CustomPreviewLineweights(Geometry=item_14, Shader=swatch_5, Absolute=False)  # disabled

swatch_6 = ColourSwatch(SwatchColor=RGB(0, 0, 0))  # disabled
previewlw_19 = CustomPreviewLineweights(Geometry=item_15, Shader=swatch_6, Absolute=False)  # disabled
previewlw_20 = CustomPreviewLineweights(Geometry=item_16, Shader=swatch_6, Absolute=False)  # disabled
